# Grasshopper definition PickPlaceWeld_Robot.gh (Grasshopper 1.0.8)
# plug-ins: RhinoCodePluginGH, Robots

# ---- group: Gripper Unclose / TCP orientation setup
tcp_unclose = Point(<point referenced from the Rhino model>)
xy_plane = XYPlane(Origin=tcp_unclose)
deconstruct_plane = DeconstructPlane(Plane=xy_plane)  # -> Origin, XAxis, YAxis, ZAxis
deconstruct_plane_2 = DeconstructPlane(Plane=xy_plane)  # -> Origin, XAxis, YAxis, ZAxis
deconstruct_plane_3 = DeconstructPlane(Plane=xy_plane)  # -> Origin, XAxis, YAxis, ZAxis
rotate_3d = Rotate3D(Geometry=xy_plane, Angle=degrees(Slider(0, range=0..100)), Center=deconstruct_plane.Origin, Axis=deconstruct_plane.XAxis)  # -> Geometry, Transform
rotate_3d_2 = Rotate3D(
    Geometry=rotate_3d.Geometry,
    Angle=degrees(Slider(90, range=0..100)),
    Center=deconstruct_plane_2.Origin,
    Axis=deconstruct_plane_2.YAxis)  # -> Geometry, Transform
rotate_3d_3 = Rotate3D(
    Geometry=rotate_3d_2.Geometry,
    Angle=degrees(Slider(0, range=0..100)),
    Center=deconstruct_plane_3.Origin,
    Axis=deconstruct_plane_3.ZAxis)  # -> Geometry, Transform

# ---- group: Gripper Close / TCP orientation setup
tcp_close = Point(<point referenced from the Rhino model>)
xy_plane_2 = XYPlane(Origin=tcp_close)
deconstruct_plane_4 = DeconstructPlane(Plane=xy_plane_2)  # -> Origin, XAxis, YAxis, ZAxis
deconstruct_plane_5 = DeconstructPlane(Plane=xy_plane_2)  # -> Origin, XAxis, YAxis, ZAxis
deconstruct_plane_6 = DeconstructPlane(Plane=xy_plane_2)  # -> Origin, XAxis, YAxis, ZAxis
rotate_3d_4 = Rotate3D(
    Geometry=xy_plane_2,
    Angle=degrees(Slider(0, range=0..100)),
    Center=deconstruct_plane_4.Origin,
    Axis=deconstruct_plane_4.XAxis)  # -> Geometry, Transform
rotate_3d_5 = Rotate3D(
    Geometry=rotate_3d_4.Geometry,
    Angle=degrees(Slider(90, range=0..100)),
    Center=deconstruct_plane_5.Origin,
    Axis=deconstruct_plane_5.YAxis)  # -> Geometry, Transform
rotate_3d_6 = Rotate3D(
    Geometry=rotate_3d_5.Geometry,
    Angle=degrees(Slider(0, range=0..100)),
    Center=deconstruct_plane_6.Origin,
    Axis=deconstruct_plane_6.ZAxis)  # -> Geometry, Transform

# ---- group: Bricks plane creation
brep = Brep([<brep referenced from the Rhino model> x8])
list_length = ListLength(List=brep)
deconstruct_brep = DeconstructBrep(Brep=brep)  # -> flatten(Faces), Edges, Vertices
series = Series(Start=2, Step=6, Count=list_length)
list_item = ListItem(List=deconstruct_brep.Faces, Index=series, Wrap=True)
polygon_center = PolygonCenter(Polyline=list_item)  # -> CenterV, CenterE, CenterA
construct_plane = ConstructPlane(Origin=polygon_center.CenterV, XAxis=Vector(1, 0, 0), YAxis=Vector(0, 1, 0))
unit_z = UnitZ(Factor="200")
flip_plane = FlipPlane(Plane=construct_plane, ReverseX=False, ReverseY=False, SwapAxes=True)
plane_offset = PlaneOffset(BasePlane=construct_plane, Offset=unit_z)
flip_plane_2 = FlipPlane(Plane=plane_offset, ReverseX=False, ReverseY=False, SwapAxes=True)

# ---- group: Table Plane Creation
brep_2 = Brep([<brep referenced from the Rhino model> x8])
list_length_2 = ListLength(List=brep_2)
deconstruct_brep_2 = DeconstructBrep(Brep=brep_2)  # -> flatten(Faces), Edges, Vertices
series_2 = Series(Start=0, Step=6, Count=list_length_2)
list_item_2 = ListItem(List=deconstruct_brep_2.Faces, Index=series_2, Wrap=True)
face_normals = FaceNormals(Mesh=list_item_2)  # -> Centers, Normals
panel = Panel("""2
3
5
6""")
plane_normal = PlaneNormal(Origin=face_normals.Centers, ZAxis=face_normals.Normals)  # -> flatten(Plane)
list_item_3 = ListItem(List=plane_normal, Index=panel, Wrap=True)
flip_plane_3 = FlipPlane(Plane=list_item_3, ReverseX=True, ReverseY=False, SwapAxes=True)
unit_z_2 = UnitZ(Factor="200")
replace_items = ReplaceItems(List=plane_normal, Item=flip_plane_3, Indices=panel, Wrap=False)
plane_offset_2 = PlaneOffset(BasePlane=replace_items, Offset=unit_z_2)

# ----
brep_3 = Brep([<brep referenced from the Rhino model> x10])
unclose_geometry = Brep([<brep referenced from the Rhino model> x11])

# ---- group: Torch Definition / TCP orientation setup
tcp_torch = Point(<point referenced from the Rhino model>)
xy_plane_3 = XYPlane(Origin=tcp_torch)
deconstruct_plane_7 = DeconstructPlane(Plane=xy_plane_3)  # -> Origin, XAxis, YAxis, ZAxis
deconstruct_plane_8 = DeconstructPlane(Plane=xy_plane_3)  # -> Origin, XAxis, YAxis, ZAxis
deconstruct_plane_9 = DeconstructPlane(Plane=xy_plane_3)  # -> Origin, XAxis, YAxis, ZAxis
rotate_3d_7 = Rotate3D(
    Geometry=xy_plane_3,
    Angle=degrees(Slider(0, range=0..100)),
    Center=deconstruct_plane_7.Origin,
    Axis=deconstruct_plane_7.XAxis)  # -> Geometry, Transform
rotate_3d_8 = Rotate3D(
    Geometry=rotate_3d_7.Geometry,
    Angle=degrees(Slider(135, range=0..150)),
    Center=deconstruct_plane_8.Origin,
    Axis=deconstruct_plane_8.YAxis)  # -> Geometry, Transform
rotate_3d_9 = Rotate3D(
    Geometry=rotate_3d_8.Geometry,
    Angle=degrees(Slider(0, range=0..100)),
    Center=deconstruct_plane_9.Origin,
    Axis=deconstruct_plane_9.ZAxis)  # -> Geometry, Transform

# ---- group: Gripper Close / Close Gripper
mesh_brep = MeshBrep(
    Brep=brep_3,
    Settings={GridMaxCount=0, GridMinCount=16, JaggedSeams=False, MaxEdgeLength=0, MinEdgeLength=0.0001, MinTolerance=0, Refine=True, RefineAngle=0, RelativeTolerance=0.65, SimplePlanes=True, Tolerance=0})
mesh = Mesh(mesh_brep)
mesh_join = MeshJoin(Meshes=mesh)

# ---- group: Gripper Unclose / Close Gripper
mesh_brep_2 = MeshBrep(
    Brep=unclose_geometry,
    Settings={GridMaxCount=0, GridMinCount=16, JaggedSeams=False, MaxEdgeLength=0, MinEdgeLength=0.0001, MinTolerance=0, Refine=True, RefineAngle=0, RelativeTolerance=0.65, SimplePlanes=True, Tolerance=0})
mesh_2 = Mesh(mesh_brep_2)
mesh_join_2 = MeshJoin(Meshes=mesh_2)

# ---- group: Gripper Close
create_tool = CreateTool(Name="GripperClose", TCP=rotate_3d_6.Geometry, Weight="5.6", Mesh=mesh_join)  # -> Tool, TCP

# ---- group: Gripper Unclose
create_tool_2 = CreateTool(Name="GripperUnclose", TCP=rotate_3d_3.Geometry, Weight="5.6", Mesh=mesh_join_2)  # -> Tool, TCP

# ----
deconstruct_plane_10 = DeconstructPlane(Plane=flip_plane)  # -> Origin, XAxis, YAxis, ZAxis

# ---- group: Home position close gripper Target
joint_configuration = Panel("0,pi/2,0,0,0,0")
speed_mm_s = Panel("2000")
zone_mm = Panel("0")
joints_parameter = JointsParameter(joint_configuration)
speed_parameter = SpeedParameter(speed_mm_s)
create_target = CreateTarget(Joints=joints_parameter, Tool=create_tool.Tool, Speed=speed_parameter, Zone=zone_mm, IsCartesian=False)

# ----
panel_2 = Panel("""SetDO out1, 0;
SetDO out2, 0;""")
deconstruct_plane_11 = DeconstructPlane(Plane=flip_plane_2)  # -> Origin, XAxis, YAxis, ZAxis
multiplication = Multiplication(A=deconstruct_plane_10.ZAxis, B=Slider(200, range=0..1000))
rotate_3d_10 = Rotate3D(
    Geometry=flip_plane,
    Angle=degrees(Slider(90, range=-180..180)),
    Center=deconstruct_plane_10.Origin,
    Axis=deconstruct_plane_10.ZAxis)  # -> Geometry, Transform
custom_command = CustomCommand(Name="GripperSignalZero", Manufacturer="All", Code=panel_2)

# ---- group: Home position unclose Target
joint_configuration_2 = Panel("0,pi/2,0,0,0,0")
speed_mm_s_2 = Panel("2000")
zone_mm_2 = Panel("0")
joints_parameter_2 = JointsParameter(joint_configuration_2)
speed_parameter_2 = SpeedParameter(speed_mm_s_2)
create_target_2 = CreateTarget(
    Joints=joints_parameter_2,
    Tool=create_tool_2.Tool,
    Speed=speed_parameter_2,
    Zone=zone_mm_2,
    Command=custom_command,
    IsCartesian=False)

# ----
flip_plane_4 = FlipPlane(Plane=replace_items, ReverseX=False, ReverseY=False, SwapAxes=True)
vector_display = VectorDisplay(Anchor=deconstruct_plane_10.Origin, Vector=multiplication)
rotate_3d_11 = Rotate3D(
    Geometry=flip_plane_2,
    Angle=degrees(Slider(90, range=-180..180)),
    Center=deconstruct_plane_11.Origin,
    Axis=deconstruct_plane_11.ZAxis)  # -> Geometry, Transform
flip_plane_5 = FlipPlane(Plane=plane_offset_2, ReverseX=False, ReverseY=False, SwapAxes=True)

curve = Curve([<curve referenced from the Rhino model> x7])
panel_3 = Panel("""1
2
4
5""")
panel_4 = Panel("""0
3
6""")
list_item_4 = ListItem(List=curve, Index=panel_4, Wrap=True)
list_item_5 = ListItem(List=curve, Index=panel_3, Wrap=True)
divide_curve = DivideCurve(Curve=list_item_5, Count=99, Kinks=False)  # -> Points, Tangents, Parameters
divide_curve_2 = DivideCurve(Curve=list_item_4, Count=99, Kinks=False)  # -> Points, Tangents, Parameters
panel_5 = Panel("""true
false""")
panel_6 = Panel("""true
false""")
dispatch = Dispatch(List=divide_curve.Points, DispatchPattern=panel_5)  # -> ListA, ListB
dispatch_2 = Dispatch(List=divide_curve_2.Points, DispatchPattern=panel_6)  # -> ListA, ListB
unit_x = UnitX(Factor="-.5")
unit_x_2 = UnitX(Factor=".5")
unit_y = UnitY(Factor=".5")
unit_y_2 = UnitY(Factor="-.5")
move = Move(Geometry=dispatch_2.ListB, Motion=unit_x)  # -> flatten(Geometry), Transform
move_2 = Move(Geometry=dispatch_2.ListA, Motion=unit_x_2)  # -> flatten(Geometry), Transform
move_3 = Move(Geometry=dispatch.ListB, Motion=unit_y_2)  # -> flatten(Geometry), Transform
move_4 = Move(Geometry=dispatch.ListA, Motion=unit_y)  # -> flatten(Geometry), Transform
list_length_3 = ListLength(List=move.Geometry)
list_length_4 = ListLength(List=move_3.Geometry)
series_3 = Series(Start=0, Step=50, Count=3)
series_4 = Series(Start=0, Step=50, Count=4)
series_5 = Series(Start=0, Step=1, Count=list_length_3)
series_6 = Series(Start=0, Step=1, Count=list_length_4)
list_item_6 = ListItem(List=move_2.Geometry, Index=series_3, Wrap=True)
insert_items = InsertItems(List=move.Geometry, Item=move_2.Geometry, Indices=series_5, Wrap=True)
insert_items_2 = InsertItems(List=move_3.Geometry, Item=move_4.Geometry, Indices=series_6, Wrap=True)
unit_z_3 = UnitZ(Factor="50")
list_item_7 = ListItem(List=move_4.Geometry, Index=series_4, Wrap=True)
unit_z_4 = UnitZ(Factor="50")
move_5 = Move(Geometry=list_item_6, Motion=unit_z_3)  # -> Geometry, Transform
xy_plane_4 = XYPlane(Origin=insert_items)
xy_plane_5 = XYPlane(Origin=insert_items_2)
move_6 = Move(Geometry=list_item_7, Motion=unit_z_4)  # -> Geometry, Transform
xy_plane_6 = XYPlane(Origin=move_5.Geometry)
xy_plane_7 = XYPlane(Origin=move_6.Geometry)

point = Point(<point referenced from the Rhino model>)
xy_plane_8 = XYPlane(Origin=point)
flip_plane_6 = FlipPlane(Plane=xy_plane_8, ReverseX=True, ReverseY=False, SwapAxes=False)
list = ValueList({"Joint", "Linear"}, selected="Joint")
series_7 = Series(Start=0, Step=1, Count=8)
create_target_3 = CreateTarget(Plane=flip_plane_6, Motion=list, Tool=create_tool_2.Tool, Speed="2000", IsCartesian=True)
flip_plane_7 = FlipPlane(Plane=xy_plane_6, ReverseX=True, ReverseY=False, SwapAxes=True)
create_frame = CreateFrame(Plane=PlaneXY(0, 0, 0), CoupledMechanicalGroup=-1, CoupledMechanism=-1)
create_target_4 = CreateTarget(IsCartesian=True)
xy_plane_9 = XYPlane(Origin=Point(0, 0, 0))
flip_plane_8 = FlipPlane(Plane=xy_plane_9, ReverseX=False, ReverseY=False, SwapAxes=False)

# ---- group: Bricks Transport Visualisation / One brick
brep_4 = Brep(<brep referenced from the Rhino model>)

# ---- group: Torch Definition
unclose_geometry_2 = Brep([<brep referenced from the Rhino model> x11])

# ---- group: Torch Definition / Close Gripper
mesh_brep_3 = MeshBrep(
    Brep=unclose_geometry_2,
    Settings={GridMaxCount=0, GridMinCount=16, JaggedSeams=False, MaxEdgeLength=0, MinEdgeLength=0.0001, MinTolerance=0, Refine=True, RefineAngle=0, RelativeTolerance=0.65, SimplePlanes=True, Tolerance=0})
mesh_3 = Mesh(mesh_brep_3)
mesh_join_3 = MeshJoin(Meshes=mesh_3)

# ---- group: Torch Definition (continued)
create_tool_3 = CreateTool(Name="Torch", TCP=rotate_3d_9.Geometry, Weight="5.6", Mesh=mesh_join_3)  # -> Tool, TCP

# ----
deconstruct_plane_12 = DeconstructPlane(Plane=create_tool_3.TCP)  # -> Origin, XAxis, YAxis, ZAxis
multiplication_2 = Multiplication(A=deconstruct_plane_12.ZAxis, B=Slider(200, range=0..1000))
vector_display_2 = VectorDisplay(Anchor=deconstruct_plane_12.Origin, Vector=multiplication_2)

# ---- group: Home definition
zone_mm_3 = Panel("0")
speed_mm_s_3 = Panel("200")
joint_configuration_3 = Panel("0,pi/2,0,0,0,0")
joints_parameter_3 = JointsParameter(joint_configuration_3)
speed_parameter_3 = SpeedParameter(speed_mm_s_3)
create_target_5 = CreateTarget(
    Joints=joints_parameter_3,
    Tool=create_tool_3.Tool,
    Speed=speed_parameter_3,
    Zone=zone_mm_3,
    Command=custom_command,
    IsCartesian=False)

# ---- group: Target Creation -B
panel_7 = Panel("""SetDO out1, 1;
WaitTime 1;
SetDO out1, 0;""")
custom_command_2 = CustomCommand(Name="CloseTheGripper", Manufacturer="All", Code=panel_7)
unclose_gripper = ToolParameter(create_tool_2.Tool)
close_gripper = ToolParameter(create_tool.Tool)
list_2 = ValueList({"Joint", "Linear"}, selected="Linear")
list_3 = ValueList({"Joint", "Linear"}, selected="Joint")
create_target_6 = CreateTarget(
    Plane=rotate_3d_10.Geometry,
    Motion=list_2,
    Tool=unclose_gripper,
    Speed="200",
    Command=custom_command_2,
    IsCartesian=True)
list_length_5 = ListLength(List=create_target_6)
create_target_7 = CreateTarget(Plane=rotate_3d_11.Geometry, Motion=list_3, Tool=unclose_gripper, Speed="2000", IsCartesian=True)
series_8 = Series(Start=2, Step=2, Count=list_length_5)
list_4 = ValueList({"Joint", "Linear"}, selected="Linear")
panel_8 = Panel("""SetDO out2, 1;
WaitTime 1;
SetDO out2, 0;""")
home_target = TargetParameter(create_target_2)
series_9 = Series(Start=0, Step=3, Count=list_length_5)
create_target_8 = CreateTarget(Plane=rotate_3d_11.Geometry, Motion=list_4, Tool=close_gripper, Speed="200", IsCartesian=True)
custom_command_3 = CustomCommand(Name="OpenTheGripper", Manufacturer="All", Code=panel_8)
series_10 = Series(Start=4, Step=4, Count=list_length_5)
list_5 = ValueList({"Joint", "Linear"}, selected="Joint")
home_target_2 = TargetParameter(create_target)
list_6 = ValueList({"Joint", "Linear"}, selected="Linear")
series_11 = Series(Start=5, Step=5, Count=list_length_5)
create_target_9 = CreateTarget(Plane=flip_plane_5, Motion=list_5, Tool=close_gripper, Speed="2000", IsCartesian=True)
joint_configuration_4 = Panel("0,pi/2,0,0,0,0")
speed_mm_s_4 = Panel("2000")
zone_mm_4 = Panel("0")
create_target_10 = CreateTarget(Plane=flip_plane_4, Motion=list_6, Tool=close_gripper, Speed="200", Command=custom_command_3, IsCartesian=True)
series_12 = Series(Start=6, Step=6, Count=list_length_5)
series_13 = Series(Start=7, Step=7, Count=list_length_5)
joints_parameter_4 = JointsParameter(joint_configuration_4)
speed_parameter_4 = SpeedParameter(speed_mm_s_4)
series_14 = Series(Start=8, Step=8, Count=list_length_5)
create_target_11 = CreateTarget(Joints=joints_parameter_4, Tool=create_tool_2.Tool, Speed=speed_parameter_4, Zone=zone_mm_4, IsCartesian=False)

# ----
insert_items_3 = InsertItems(List=create_target_7, Item=create_target_3, Indices=series_7, Wrap=True)

# ---- group: Target Creation -B (continued)
insert_items_4 = InsertItems(List=insert_items_3, Item=create_target_6, Indices=series_8, Wrap=True)
insert_items_5 = InsertItems(List=insert_items_4, Item=home_target, Indices=series_9, Wrap=True)
insert_items_6 = InsertItems(List=insert_items_5, Item=create_target_8, Indices=series_10, Wrap=True)
insert_items_7 = InsertItems(List=insert_items_6, Item=home_target_2, Indices=series_11, Wrap=True)
insert_items_8 = InsertItems(List=insert_items_7, Item=create_target_9, Indices=series_12, Wrap=True)
insert_items_9 = InsertItems(List=insert_items_8, Item=create_target_10, Indices=series_13, Wrap=True)
insert_items_10 = InsertItems(List=insert_items_9, Item=create_target_11, Indices=series_14, Wrap=True)

# ----
panel_9 = Panel(insert_items_4)
panel_10 = Panel(insert_items_5)

series_15 = Series(Start=49, Step=50, Count=3)
series_16 = Series(Start=49, Step=50, Count=4)
list_item_8 = ListItem(List=move.Geometry, Index=series_15, Wrap=True)
unit_z_5 = UnitZ(Factor="50")
list_item_9 = ListItem(List=move_3.Geometry, Index=series_16, Wrap=True)
unit_z_6 = UnitZ(Factor="50")
move_7 = Move(Geometry=list_item_8, Motion=unit_z_5)  # -> Geometry, Transform
move_8 = Move(Geometry=list_item_9, Motion=unit_z_6)  # -> Geometry, Transform
list_item_10 = ListItem(List=insert_items, Index=Slider(99, range=0..100), Wrap=True)
list_item_11 = ListItem(List=xy_plane_5, Index=Slider(399, range=0..1000), Wrap=True)
xy_plane_10 = XYPlane(Origin=move_7.Geometry)
xy_plane_11 = XYPlane(Origin=move_8.Geometry)
panel_11 = Panel("""0
2
4""")
panel_12 = Panel("""0
2
4""")
torch = ToolParameter(create_tool_3.Tool)
partition_list = PartitionList(List=xy_plane_4, Size="100")  # -> simplify(Chunks)
partition_list_2 = PartitionList(List=xy_plane_5, Size="100")  # -> simplify(Chunks)
insert_items_11 = InsertItems(List=xy_plane_7, Item=flip_plane_7, Indices=panel_11, Wrap=True)
list_7 = ValueList({"Joint", "Linear"}, selected="Joint")
explode_tree = ExplodeTree(Data=partition_list_2)  # -> Branch0, Branch1, Branch2, Branch3
list_8 = ValueList({"Joint", "Linear"}, selected="Linear")
create_target_12 = CreateTarget(Plane=insert_items_11, Motion=list_7, Tool=torch, Speed="200", IsCartesian=True)
list_9 = ValueList({"Joint", "Linear"}, selected="Linear")
series_17 = Series(Start=0, Step=100, Count=7)
series_18 = Series(Start=101, Step=101, Count=7)

flip_plane_9 = FlipPlane(Plane=xy_plane_10, ReverseX=True, ReverseY=False, SwapAxes=True)
flip_plane_10 = FlipPlane(Plane=partition_list, ReverseX=True, ReverseY=False, SwapAxes=True)
list_item_12 = ListItem(List=insert_items_11, Index=Slider(6, range=0..10), Wrap=True)

insert_items_12 = InsertItems(List=xy_plane_11, Item=flip_plane_9, Indices=panel_12, Wrap=True)
explode_tree_2 = ExplodeTree(Data=flip_plane_10)  # -> Branch0, Branch1, Branch2
create_target_13 = CreateTarget(Plane=insert_items_12, Motion=list_8, Tool=torch, Speed="10", IsCartesian=True)
merge = Merge(
    Data1=explode_tree_2.Branch0,
    Data2=explode_tree.Branch0,
    Data3=explode_tree.Branch1,
    Data4=explode_tree_2.Branch1,
    Data5=explode_tree.Branch2,
    Data6=explode_tree.Branch3)  # -> flatten(Result)

list_item_13 = ListItem(List=insert_items_12, Index=Slider(0, range=0..10), Wrap=True)
merge_2 = Merge(Data1=merge, Data2=explode_tree_2.Branch2)  # -> flatten(Result)

create_target_14 = CreateTarget(Plane=merge_2, Motion=list_9, Tool=torch, Speed="10", IsCartesian=True)
insert_items_13 = InsertItems(List=create_target_14, Item=create_target_12, Indices=series_17, Wrap=True)
insert_items_14 = InsertItems(List=insert_items_13, Item=create_target_13, Indices=series_18, Wrap=True)
merge_3 = Merge(Data1=flatten(create_target_5), Data2=flatten(insert_items_14), Data3=flatten(create_target_5))

merge_4 = Merge(Data1=flatten(insert_items_10), Data2=flatten(create_target_5), Data3=flatten(merge_3), Data4=flatten(create_target_5))

# ---- group: Programm Generation
list_10 = RobotsLibrary(
    {"Indexlab-IRB6700-175", "Indexlab-IRB6700-175 + Positioner", "Indexlab", "Indexlab_ABB_IRB4600_205", "FanucM710iC", "FanucM710iC+GudelFanuc", "Fanuc R 2000 iC", "Fanuc R 2000 iC+GudelFanuc", "Fanuc Cell Indexlab", "Indexlab_Fanuc_LRMate200iD7L"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}, selected="Indexlab_ABB_IRB4600_205",
    Type=0)
load_robot_system = LoadRobotSystem(Name=list_10, Base=flip_plane_8)
create_program = CreateProgram(Name="Home", RobotSystem=load_robot_system, Targets=merge_4, StepSize=1)  # -> Program, Code, Duration, Warnings, Errors
panel_13 = Panel(create_program.Warnings)

# ----
panel_14 = Panel(create_program.Duration)
panel_15 = Panel(create_program.Errors)
code = Panel(create_program.Code)

# ---- group: Simulation
number_slider = Slider(0, range=0..1)

program_simulation = ProgramSimulation(Program=create_program.Program, Time=number_slider, Normalized=True)  # -> SystemMeshes, JointRotations, Plane, Index, Time, Program, Errors

# ----
degrees = Degrees(Radians=program_simulation.JointRotations)

# ---- group: Simulation (continued)
target_index = Panel(program_simulation.Index)
time = Panel(program_simulation.Time)
errors = Panel(degrees)

# ---- group: Table collision check
brep_5 = Brep(<brep referenced from the Rhino model>)
mesh_brep_4 = MeshBrep(
    Brep=brep_5,
    Settings={GridMaxCount=0, GridMinCount=16, JaggedSeams=False, MaxEdgeLength=0, MinEdgeLength=0.0001, MinTolerance=0, Refine=True, RefineAngle=0, RelativeTolerance=0.65, SimplePlanes=True, Tolerance=0})
collision_one_many = CollisionOneMany(Collider=program_simulation.SystemMeshes, Obstacles=mesh_brep_4)  # -> Collision, Index
panel_16 = Panel(collision_one_many.Collision)

# ---- group: Bricks Transport Visualisation / TCP Plane
list_item_14 = ListItem(List=program_simulation.Plane, Index=-1, Wrap=True)

# ---- group: Collision checked on brick / Tool
list_item_15 = ListItem(List=program_simulation.SystemMeshes, Index=7, Wrap=True)

# ---- group: Bricks Transport Visualisation
deconstruct_brep_3 = DeconstructBrep(Brep=brep_4)  # -> Faces, Edges, Vertices
rotate_plane = RotatePlane(Plane=deconstruct_brep_3.Faces, Angle=degrees("90"))
plane_offset_3 = PlaneOffset(BasePlane=rotate_plane, Offset="-80")
list_item_16 = ListItem(List=plane_offset_3, Index=0, Wrap=True)
orient = Orient(Geometry=brep_4, Source=list_item_16, Target=list_item_14)  # -> Geometry, Transform
create_material = CreateMaterial(
    Diffuse=ColourSwatch(SwatchColor=RGB(23, 172, 255)),
    Specular=RGB(255, 255, 255),
    Emission=RGB(0, 0, 0),
    Transparency=0,
    Shine=0)

# ---- group: Collision checked on brick
collision_one_many_2 = CollisionOneMany(Collider=list_item_15, Obstacles=orient.Geometry)  # -> Collision, Index
python_3_script = Python3Script(x=collision_one_many_2.Collision, y=orient.Geometry, z=program_simulation.Index)  # -> out, a
# ---------- python_3_script: Python ----------
if x==True and z <=72:
    a = y
else:
    a = None
# ---------- end python_3_script ----------

# ----
panel_17 = Panel(collision_one_many_2.Collision)

# ---- group: Bricks Transport Visualisation (continued)
custom_preview = CustomPreview(Geometry=python_3_script.a, Material=create_material)
