# Grasshopper definition PickPlaceWeld_RobotComponent.gh (Grasshopper 1.0.8)
# plug-ins: Robot Components

# ---- group: Gripper Close / TCP orientation setup
tcp_close = Point(<point referenced from the Rhino model>)
xy_plane = XYPlane(Origin=tcp_close)
deconstruct_plane = DeconstructPlane(Plane=xy_plane)  # -> Origin, XAxis, YAxis, ZAxis
deconstruct_plane_2 = DeconstructPlane(Plane=xy_plane)  # -> Origin, XAxis, YAxis, ZAxis
deconstruct_plane_3 = DeconstructPlane(Plane=xy_plane)  # -> Origin, XAxis, YAxis, ZAxis
rotate_3d = Rotate3D(Geometry=xy_plane, Angle=degrees(Slider(0, range=0..100)), Center=deconstruct_plane.Origin, Axis=deconstruct_plane.XAxis)  # -> Geometry, Transform
rotate_3d_2 = Rotate3D(
    Geometry=rotate_3d.Geometry,
    Angle=degrees(Slider(90, range=0..100)),
    Center=deconstruct_plane_2.Origin,
    Axis=deconstruct_plane_2.YAxis)  # -> Geometry, Transform
rotate_3d_3 = Rotate3D(
    Geometry=rotate_3d_2.Geometry,
    Angle=degrees(Slider(0, range=0..100)),
    Center=deconstruct_plane_3.Origin,
    Axis=deconstruct_plane_3.ZAxis)  # -> Geometry, Transform

# ----
brep = Brep([<brep referenced from the Rhino model> x8])
list_length = ListLength(List=brep)
deconstruct_brep = DeconstructBrep(Brep=brep)  # -> flatten(Faces), Edges, Vertices
series = Series(Start=0, Step=6, Count=list_length)
list_item = ListItem(List=deconstruct_brep.Faces, Index=series, Wrap=True)
face_normals = FaceNormals(Mesh=list_item)  # -> Centers, Normals
panel = Panel("""2
3
5
6""")
plane_normal = PlaneNormal(Origin=face_normals.Centers, ZAxis=face_normals.Normals)  # -> flatten(Plane)
list_item_2 = ListItem(List=plane_normal, Index=panel, Wrap=True)
flip_plane = FlipPlane(Plane=list_item_2, ReverseX=True, ReverseY=False, SwapAxes=True)
unit_z = UnitZ(Factor="200")
replace_items = ReplaceItems(List=plane_normal, Item=flip_plane, Indices=panel, Wrap=False)
plane_offset = PlaneOffset(BasePlane=replace_items, Offset=unit_z)
flip_plane_2 = FlipPlane(Plane=replace_items, ReverseX=False, ReverseY=False, SwapAxes=True)
flip_plane_3 = FlipPlane(Plane=plane_offset, ReverseX=False, ReverseY=False, SwapAxes=True)

# ---- group: Torch Definition / TCP orientation setup
tcp_torch = Point(<point referenced from the Rhino model>)
xy_plane_2 = XYPlane(Origin=tcp_torch)
deconstruct_plane_4 = DeconstructPlane(Plane=xy_plane_2)  # -> Origin, XAxis, YAxis, ZAxis
deconstruct_plane_5 = DeconstructPlane(Plane=xy_plane_2)  # -> Origin, XAxis, YAxis, ZAxis
deconstruct_plane_6 = DeconstructPlane(Plane=xy_plane_2)  # -> Origin, XAxis, YAxis, ZAxis
rotate_3d_4 = Rotate3D(
    Geometry=xy_plane_2,
    Angle=degrees(Slider(0, range=0..100)),
    Center=deconstruct_plane_4.Origin,
    Axis=deconstruct_plane_4.XAxis)  # -> Geometry, Transform
rotate_3d_5 = Rotate3D(
    Geometry=rotate_3d_4.Geometry,
    Angle=degrees(Slider(135, range=0..150)),
    Center=deconstruct_plane_5.Origin,
    Axis=deconstruct_plane_5.YAxis)  # -> Geometry, Transform
rotate_3d_6 = Rotate3D(
    Geometry=rotate_3d_5.Geometry,
    Angle=degrees(Slider(0, range=0..100)),
    Center=deconstruct_plane_6.Origin,
    Axis=deconstruct_plane_6.ZAxis)  # -> Geometry, Transform

# ---- group: Bricks plane creation
brep_2 = Brep([<brep referenced from the Rhino model> x8])
list_length_2 = ListLength(List=brep_2)
deconstruct_brep_2 = DeconstructBrep(Brep=brep_2)  # -> flatten(Faces), Edges, Vertices
series_2 = Series(Start=2, Step=6, Count=list_length_2)
list_item_3 = ListItem(List=deconstruct_brep_2.Faces, Index=series_2, Wrap=True)
polygon_center = PolygonCenter(Polyline=list_item_3)  # -> CenterV, CenterE, CenterA
construct_plane = ConstructPlane(Origin=polygon_center.CenterV, XAxis=Vector(1, 0, 0), YAxis=Vector(0, 1, 0))
unit_z_2 = UnitZ(Factor="200")
flip_plane_4 = FlipPlane(Plane=construct_plane, ReverseX=False, ReverseY=False, SwapAxes=True)
plane_offset_2 = PlaneOffset(BasePlane=construct_plane, Offset=unit_z_2)
flip_plane_5 = FlipPlane(Plane=plane_offset_2, ReverseX=False, ReverseY=False, SwapAxes=True)

# ----
brep_3 = Brep([<brep referenced from the Rhino model> x9])

# ---- group: Gripper Close / Close Gripper
mesh_brep = MeshBrep(
    Brep=brep_3,
    Settings={GridMaxCount=0, GridMinCount=16, JaggedSeams=False, MaxEdgeLength=0, MinEdgeLength=0.0001, MinTolerance=0, Refine=True, RefineAngle=0, RelativeTolerance=0.65, SimplePlanes=True, Tolerance=0})
mesh = Mesh(mesh_brep)
mesh_join = MeshJoin(Meshes=mesh)

# ---- group: Gripper Close
load_data = LoadData(Mass="5.6")
robot_tool = RobotTool(
    Name="GripperClose",
    Mesh=mesh_join,
    AttachmentPlane=PlaneXY(0, 0, 0),
    ToolPlane=rotate_3d_3.Geometry,
    LoadData=load_data)

# ----
deconstruct_plane_7 = DeconstructPlane(Plane=flip_plane_4)  # -> Origin, XAxis, YAxis, ZAxis
multiplication = Multiplication(A=deconstruct_plane_7.ZAxis, B=Slider(200, range=0..1000))

point = Point(<point referenced from the Rhino model>)
xy_plane_3 = XYPlane(Origin=point)
work_object = WorkObject(Name="TableFrame", Plane=xy_plane_3)

vector_display = VectorDisplay(Anchor=deconstruct_plane_7.Origin, Vector=multiplication)

point_2 = Point(<point referenced from the Rhino model>)
point_3 = Point(<point referenced from the Rhino model>)
xy_plane_4 = XYPlane(Origin=point_3)
xy_plane_5 = XYPlane(Origin=point_2)
work_object_2 = WorkObject(Name="TableFrame", Plane=xy_plane_4)
work_object_3 = WorkObject(Name="BrickFrame", Plane=xy_plane_5)

deconstruct_plane_8 = DeconstructPlane(Plane=flip_plane_5)  # -> Origin, XAxis, YAxis, ZAxis
rotate_3d_7 = Rotate3D(
    Geometry=flip_plane_4,
    Angle=degrees(Slider(90, range=-180..180)),
    Center=deconstruct_plane_7.Origin,
    Axis=deconstruct_plane_7.ZAxis)  # -> Geometry, Transform
rotate_3d_8 = Rotate3D(
    Geometry=flip_plane_5,
    Angle=degrees(Slider(90, range=-180..180)),
    Center=deconstruct_plane_8.Origin,
    Axis=deconstruct_plane_8.ZAxis)  # -> Geometry, Transform

curve = Curve([<curve referenced from the Rhino model> x7])
panel_2 = Panel("""1
2
4
5""")
panel_3 = Panel("""0
3
6""")
list_item_4 = ListItem(List=curve, Index=panel_3, Wrap=True)
list_item_5 = ListItem(List=curve, Index=panel_2, Wrap=True)
divide_curve = DivideCurve(Curve=list_item_5, Count=99, Kinks=False)  # -> Points, Tangents, Parameters
divide_curve_2 = DivideCurve(Curve=list_item_4, Count=99, Kinks=False)  # -> Points, Tangents, Parameters
panel_4 = Panel("""true
false""")
panel_5 = Panel("""true
false""")
dispatch = Dispatch(List=divide_curve.Points, DispatchPattern=panel_4)  # -> ListA, ListB
dispatch_2 = Dispatch(List=divide_curve_2.Points, DispatchPattern=panel_5)  # -> ListA, ListB
unit_x = UnitX(Factor="-.5")
unit_x_2 = UnitX(Factor=".5")
unit_y = UnitY(Factor=".5")
unit_y_2 = UnitY(Factor="-.5")
move = Move(Geometry=dispatch_2.ListB, Motion=unit_x)  # -> flatten(Geometry), Transform
move_2 = Move(Geometry=dispatch_2.ListA, Motion=unit_x_2)  # -> flatten(Geometry), Transform
move_3 = Move(Geometry=dispatch.ListB, Motion=unit_y_2)  # -> flatten(Geometry), Transform
move_4 = Move(Geometry=dispatch.ListA, Motion=unit_y)  # -> flatten(Geometry), Transform
list_length_3 = ListLength(List=move.Geometry)
list_length_4 = ListLength(List=move_3.Geometry)
series_3 = Series(Start=0, Step=50, Count=3)
series_4 = Series(Start=0, Step=50, Count=4)
series_5 = Series(Start=0, Step=1, Count=list_length_3)
series_6 = Series(Start=0, Step=1, Count=list_length_4)
list_item_6 = ListItem(List=move_2.Geometry, Index=series_3, Wrap=True)
insert_items = InsertItems(List=move.Geometry, Item=move_2.Geometry, Indices=series_5, Wrap=True)
insert_items_2 = InsertItems(List=move_3.Geometry, Item=move_4.Geometry, Indices=series_6, Wrap=True)
unit_z_3 = UnitZ(Factor="50")
list_item_7 = ListItem(List=move_4.Geometry, Index=series_4, Wrap=True)
unit_z_4 = UnitZ(Factor="50")
move_5 = Move(Geometry=list_item_6, Motion=unit_z_3)  # -> Geometry, Transform
xy_plane_6 = XYPlane(Origin=insert_items)
xy_plane_7 = XYPlane(Origin=insert_items_2)
move_6 = Move(Geometry=list_item_7, Motion=unit_z_4)  # -> Geometry, Transform
xy_plane_8 = XYPlane(Origin=move_5.Geometry)
xy_plane_9 = XYPlane(Origin=move_6.Geometry)

robot_tool_2 = RobotTool(robot_tool)

robot_joint_position = RobotJointPosition(
    RobotJointPosition1=0,
    RobotJointPosition2=1.570796327,
    RobotJointPosition3=0,
    RobotJointPosition4=0,
    RobotJointPosition5=0,
    RobotJointPosition6=0)
joint_target = JointTarget(RobotJointPosition=robot_joint_position)
robot_target = RobotTarget(Plane=rotate_3d_7.Geometry, ReferencePlane=work_object_3, Set_External_Joint_Position=False, Set_Reference_Plane=True)
robot_target_2 = RobotTarget(Plane=flip_plane_3, ReferencePlane=work_object_2, Set_External_Joint_Position=False, Set_Reference_Plane=True)
robot_target_3 = RobotTarget(Plane=flip_plane_2, ReferencePlane=work_object_2, Set_External_Joint_Position=False, Set_Reference_Plane=True)
robot_target_4 = RobotTarget(Plane=rotate_3d_8.Geometry, ReferencePlane=work_object_3, Set_External_Joint_Position=False, Set_Reference_Plane=True)
robot_target_5 = RobotTarget(Plane=rotate_3d_8.Geometry, ReferencePlane=work_object_3, Set_External_Joint_Position=False, Set_Reference_Plane=True)
robot_target_6 = RobotTarget(Plane=flip_plane_3, ReferencePlane=work_object_2, Set_External_Joint_Position=False, Set_Reference_Plane=True)
list_length_5 = ListLength(List=rotate_3d_8.Geometry)
list = ValueList({"v5": 5, "v10": 10, "v20": 20, "v30": 30, "v40": 40, "v50": 50, "v60": 60, "v80": 80, "v100": 100, "v150": 150, "v200": 200, "v300": 300, "v400": 400, "v500": 500, "v600": 600, "v800": 800, "v1000": 1000, "v1500": 1500, "v2000": 2000, "v2500": 2500, "v3000": 3000, "v4000": 4000, "v5000": 5000, "v6000": 6000, "v7000": 7000}, selected="v200")
list_2 = ValueList({"z0": 0, "z1": 1, "z5": 5, "z10": 10, "z15": 15, "z20": 20, "z30": 30, "z40": 40, "z50": 50, "z60": 60, "z80": 80, "z100": 100, "z150": 150, "z200": 200, "fine": -1}, selected="fine")
list_3 = ValueList({"MoveAbsJ": 0, "MoveL": 1, "MoveJ": 2, "MoveC": 3}, selected="MoveAbsJ")
list_4 = ValueList({"MoveAbsJ": 0, "MoveL": 1, "MoveJ": 2, "MoveC": 3}, selected="MoveJ")
list_5 = ValueList({"MoveAbsJ": 0, "MoveL": 1, "MoveJ": 2, "MoveC": 3}, selected="MoveL")
list_6 = ValueList({"MoveAbsJ": 0, "MoveL": 1, "MoveJ": 2, "MoveC": 3}, selected="MoveJ")
list_7 = ValueList({"MoveAbsJ": 0, "MoveL": 1, "MoveJ": 2, "MoveC": 3}, selected="MoveL")
list_8 = ValueList({"v5": 5, "v10": 10, "v20": 20, "v30": 30, "v40": 40, "v50": 50, "v60": 60, "v80": 80, "v100": 100, "v150": 150, "v200": 200, "v300": 300, "v400": 400, "v500": 500, "v600": 600, "v800": 800, "v1000": 1000, "v1500": 1500, "v2000": 2000, "v2500": 2500, "v3000": 3000, "v4000": 4000, "v5000": 5000, "v6000": 6000, "v7000": 7000}, selected="v200")
list_9 = ValueList({"v5": 5, "v10": 10, "v20": 20, "v30": 30, "v40": 40, "v50": 50, "v60": 60, "v80": 80, "v100": 100, "v150": 150, "v200": 200, "v300": 300, "v400": 400, "v500": 500, "v600": 600, "v800": 800, "v1000": 1000, "v1500": 1500, "v2000": 2000, "v2500": 2500, "v3000": 3000, "v4000": 4000, "v5000": 5000, "v6000": 6000, "v7000": 7000}, selected="v50")
list_10 = ValueList({"v5": 5, "v10": 10, "v20": 20, "v30": 30, "v40": 40, "v50": 50, "v60": 60, "v80": 80, "v100": 100, "v150": 150, "v200": 200, "v300": 300, "v400": 400, "v500": 500, "v600": 600, "v800": 800, "v1000": 1000, "v1500": 1500, "v2000": 2000, "v2500": 2500, "v3000": 3000, "v4000": 4000, "v5000": 5000, "v6000": 6000, "v7000": 7000}, selected="v200")
list_11 = ValueList({"v5": 5, "v10": 10, "v20": 20, "v30": 30, "v40": 40, "v50": 50, "v60": 60, "v80": 80, "v100": 100, "v150": 150, "v200": 200, "v300": 300, "v400": 400, "v500": 500, "v600": 600, "v800": 800, "v1000": 1000, "v1500": 1500, "v2000": 2000, "v2500": 2500, "v3000": 3000, "v4000": 4000, "v5000": 5000, "v6000": 6000, "v7000": 7000}, selected="v50")
list_12 = ValueList({"MoveAbsJ": 0, "MoveL": 1, "MoveJ": 2, "MoveC": 3}, selected="MoveL")
list_13 = ValueList({"MoveAbsJ": 0, "MoveL": 1, "MoveJ": 2, "MoveC": 3}, selected="MoveL")
list_14 = ValueList({"v5": 5, "v10": 10, "v20": 20, "v30": 30, "v40": 40, "v50": 50, "v60": 60, "v80": 80, "v100": 100, "v150": 150, "v200": 200, "v300": 300, "v400": 400, "v500": 500, "v600": 600, "v800": 800, "v1000": 1000, "v1500": 1500, "v2000": 2000, "v2500": 2500, "v3000": 3000, "v4000": 4000, "v5000": 5000, "v6000": 6000, "v7000": 7000}, selected="v50")
list_15 = ValueList({"v5": 5, "v10": 10, "v20": 20, "v30": 30, "v40": 40, "v50": 50, "v60": 60, "v80": 80, "v100": 100, "v150": 150, "v200": 200, "v300": 300, "v400": 400, "v500": 500, "v600": 600, "v800": 800, "v1000": 1000, "v1500": 1500, "v2000": 2000, "v2500": 2500, "v3000": 3000, "v4000": 4000, "v5000": 5000, "v6000": 6000, "v7000": 7000}, selected="v50")
list_16 = ValueList({"z0": 0, "z1": 1, "z5": 5, "z10": 10, "z15": 15, "z20": 20, "z30": 30, "z40": 40, "z50": 50, "z60": 60, "z80": 80, "z100": 100, "z150": 150, "z200": 200, "fine": -1}, selected="fine")
list_17 = ValueList({"z0": 0, "z1": 1, "z5": 5, "z10": 10, "z15": 15, "z20": 20, "z30": 30, "z40": 40, "z50": 50, "z60": 60, "z80": 80, "z100": 100, "z150": 150, "z200": 200, "fine": -1}, selected="fine")
list_18 = ValueList({"z0": 0, "z1": 1, "z5": 5, "z10": 10, "z15": 15, "z20": 20, "z30": 30, "z40": 40, "z50": 50, "z60": 60, "z80": 80, "z100": 100, "z150": 150, "z200": 200, "fine": -1}, selected="fine")
list_19 = ValueList({"z0": 0, "z1": 1, "z5": 5, "z10": 10, "z15": 15, "z20": 20, "z30": 30, "z40": 40, "z50": 50, "z60": 60, "z80": 80, "z100": 100, "z150": 150, "z200": 200, "fine": -1}, selected="fine")
list_20 = ValueList({"z0": 0, "z1": 1, "z5": 5, "z10": 10, "z15": 15, "z20": 20, "z30": 30, "z40": 40, "z50": 50, "z60": 60, "z80": 80, "z100": 100, "z150": 150, "z200": 200, "fine": -1}, selected="fine")
list_21 = ValueList({"z0": 0, "z1": 1, "z5": 5, "z10": 10, "z15": 15, "z20": 20, "z30": 30, "z40": 40, "z50": 50, "z60": 60, "z80": 80, "z100": 100, "z150": 150, "z200": 200, "fine": -1}, selected="fine")
move_7 = Move(
    Type=list_3,
    Target=joint_target,
    SpeedData=list,
    ZoneData=list_2,
    RobotTool=robot_tool_2,
    Override_Robot_Tool=True,
    Override_Work_Object=True,
    Set_Circular_Point=False,
    Set_Digital_Output=False,
    Set_Movement_Time=False)
move_8 = Move(
    Type=list_4,
    Target=robot_target_2,
    SpeedData=list_8,
    ZoneData=list_16,
    RobotTool=robot_tool_2,
    WorkObject=work_object_2,
    Override_Robot_Tool=True,
    Override_Work_Object=True,
    Set_Circular_Point=False,
    Set_Digital_Output=False,
    Set_Movement_Time=False)
move_9 = Move(
    Type=list_5,
    Target=robot_target_3,
    SpeedData=list_9,
    ZoneData=list_17,
    RobotTool=robot_tool_2,
    WorkObject=work_object_2,
    Override_Robot_Tool=True,
    Override_Work_Object=True,
    Set_Circular_Point=False,
    Set_Digital_Output=False,
    Set_Movement_Time=False)
move_10 = Move(
    Type=list_6,
    Target=robot_target_4,
    SpeedData=list_10,
    ZoneData=list_18,
    RobotTool=robot_tool_2,
    WorkObject=work_object_3,
    Override_Robot_Tool=True,
    Override_Work_Object=True,
    Set_Circular_Point=False,
    Set_Digital_Output=False,
    Set_Movement_Time=False)
move_11 = Move(
    Type=list_7,
    Target=robot_target_5,
    SpeedData=list_11,
    ZoneData=list_19,
    RobotTool=robot_tool_2,
    WorkObject=work_object_3,
    Override_Robot_Tool=True,
    Override_Work_Object=True,
    Set_Circular_Point=False,
    Set_Digital_Output=False,
    Set_Movement_Time=False)
move_12 = Move(
    Type=list_12,
    Target=robot_target_6,
    SpeedData=list_15,
    ZoneData=list_20,
    RobotTool=robot_tool_2,
    WorkObject=work_object_2,
    Override_Robot_Tool=True,
    Override_Work_Object=True,
    Set_Circular_Point=False,
    Set_Digital_Output=False,
    Set_Movement_Time=False)
move_13 = Move(
    Type=list_13,
    Target=robot_target,
    SpeedData=list_14,
    ZoneData=list_21,
    RobotTool=robot_tool_2,
    WorkObject=work_object_3,
    Override_Robot_Tool=True,
    Override_Work_Object=True,
    Set_Circular_Point=False,
    Set_Digital_Output=False,
    Set_Movement_Time=False)
series_7 = Series(Start=0, Step=1, Count=8)
insert_items_3 = InsertItems(List=move_10, Item=move_7, Indices=series_7, Wrap=True)
series_8 = Series(Start=2, Step=2, Count=list_length_5)
series_9 = Series(Start=3, Step=3, Count=list_length_5)
insert_items_4 = InsertItems(List=insert_items_3, Item=move_13, Indices=series_8, Wrap=True)
series_10 = Series(Start=4, Step=4, Count=list_length_5)
insert_items_5 = InsertItems(List=insert_items_4, Item=move_11, Indices=series_9, Wrap=True)
series_11 = Series(Start=5, Step=5, Count=list_length_5)
insert_items_6 = InsertItems(List=insert_items_5, Item=move_7, Indices=series_10, Wrap=True)
series_12 = Series(Start=6, Step=6, Count=list_length_5)
insert_items_7 = InsertItems(List=insert_items_6, Item=move_8, Indices=series_11, Wrap=True)
series_13 = Series(Start=7, Step=7, Count=list_length_5)
insert_items_8 = InsertItems(List=insert_items_7, Item=move_9, Indices=series_12, Wrap=True)
series_14 = Series(Start=8, Step=8, Count=list_length_5)
insert_items_9 = InsertItems(List=insert_items_8, Item=move_12, Indices=series_13, Wrap=True)
insert_items_10 = InsertItems(List=insert_items_9, Item=move_7, Indices=series_14, Wrap=True)

flip_plane_6 = FlipPlane(Plane=xy_plane_8, ReverseX=True, ReverseY=False, SwapAxes=True)
list_22 = ValueList({"MoveAbsJ": 0, "MoveL": 1, "MoveJ": 2, "MoveC": 3}, selected="MoveJ")
list_23 = ValueList({"v5": 5, "v10": 10, "v20": 20, "v30": 30, "v40": 40, "v50": 50, "v60": 60, "v80": 80, "v100": 100, "v150": 150, "v200": 200, "v300": 300, "v400": 400, "v500": 500, "v600": 600, "v800": 800, "v1000": 1000, "v1500": 1500, "v2000": 2000, "v2500": 2500, "v3000": 3000, "v4000": 4000, "v5000": 5000, "v6000": 6000, "v7000": 7000}, selected="v200")
list_24 = ValueList({"z0": 0, "z1": 1, "z5": 5, "z10": 10, "z15": 15, "z20": 20, "z30": 30, "z40": 40, "z50": 50, "z60": 60, "z80": 80, "z100": 100, "z150": 150, "z200": 200, "fine": -1}, selected="fine")
list_25 = ValueList({"MoveAbsJ": 0, "MoveL": 1, "MoveJ": 2, "MoveC": 3}, selected="MoveL")
list_26 = ValueList({"v5": 5, "v10": 10, "v20": 20, "v30": 30, "v40": 40, "v50": 50, "v60": 60, "v80": 80, "v100": 100, "v150": 150, "v200": 200, "v300": 300, "v400": 400, "v500": 500, "v600": 600, "v800": 800, "v1000": 1000, "v1500": 1500, "v2000": 2000, "v2500": 2500, "v3000": 3000, "v4000": 4000, "v5000": 5000, "v6000": 6000, "v7000": 7000}, selected="v10")
list_27 = ValueList({"z0": 0, "z1": 1, "z5": 5, "z10": 10, "z15": 15, "z20": 20, "z30": 30, "z40": 40, "z50": 50, "z60": 60, "z80": 80, "z100": 100, "z150": 150, "z200": 200, "fine": -1}, selected="fine")
list_28 = ValueList({"MoveAbsJ": 0, "MoveL": 1, "MoveJ": 2, "MoveC": 3}, selected="MoveL")
list_29 = ValueList({"v5": 5, "v10": 10, "v20": 20, "v30": 30, "v40": 40, "v50": 50, "v60": 60, "v80": 80, "v100": 100, "v150": 150, "v200": 200, "v300": 300, "v400": 400, "v500": 500, "v600": 600, "v800": 800, "v1000": 1000, "v1500": 1500, "v2000": 2000, "v2500": 2500, "v3000": 3000, "v4000": 4000, "v5000": 5000, "v6000": 6000, "v7000": 7000}, selected="v10")
list_30 = ValueList({"z0": 0, "z1": 1, "z5": 5, "z10": 10, "z15": 15, "z20": 20, "z30": 30, "z40": 40, "z50": 50, "z60": 60, "z80": 80, "z100": 100, "z150": 150, "z200": 200, "fine": -1}, selected="fine")

xy_plane_10 = XYPlane(Origin=Point(0, 0, 0))
plane_offset_3 = PlaneOffset(BasePlane=xy_plane_10, Offset="500")
robot_preset = RobotPreset(PositionPlane=plane_offset_3, RobotTool=robot_tool, Robot_Preset_Number=19)

tcp_unclose = Point(<point referenced from the Rhino model>)
xy_plane_11 = XYPlane(Origin=tcp_unclose)
unclose_geometry = Brep([<brep referenced from the Rhino model> x9])
deconstruct_plane_9 = DeconstructPlane(Plane=xy_plane_11)  # -> Origin, XAxis, YAxis, ZAxis
deconstruct_plane_10 = DeconstructPlane(Plane=xy_plane_11)  # -> Origin, XAxis, YAxis, ZAxis
deconstruct_plane_11 = DeconstructPlane(Plane=xy_plane_11)  # -> Origin, XAxis, YAxis, ZAxis
rotate_3d_9 = Rotate3D(
    Geometry=xy_plane_11,
    Angle=degrees(Slider(0, range=0..100)),
    Center=deconstruct_plane_9.Origin,
    Axis=deconstruct_plane_9.XAxis)  # -> Geometry, Transform
rotate_3d_10 = Rotate3D(
    Geometry=rotate_3d_9.Geometry,
    Angle=degrees(Slider(90, range=0..100)),
    Center=deconstruct_plane_10.Origin,
    Axis=deconstruct_plane_10.YAxis)  # -> Geometry, Transform
rotate_3d_11 = Rotate3D(
    Geometry=rotate_3d_10.Geometry,
    Angle=degrees(Slider(0, range=0..100)),
    Center=deconstruct_plane_11.Origin,
    Axis=deconstruct_plane_11.ZAxis)  # -> Geometry, Transform
load_data_2 = LoadData(Mass="5.6")

# ---- group: Close Gripper
mesh_brep_2 = MeshBrep(
    Brep=unclose_geometry,
    Settings={GridMaxCount=0, GridMinCount=16, JaggedSeams=False, MaxEdgeLength=0, MinEdgeLength=0.0001, MinTolerance=0, Refine=True, RefineAngle=0, RelativeTolerance=0.65, SimplePlanes=True, Tolerance=0})
mesh_2 = Mesh(mesh_brep_2)
mesh_join_2 = MeshJoin(Meshes=mesh_2)

# ----
robot_tool_3 = RobotTool(
    Name="GripperUnclose",
    Mesh=mesh_join_2,
    AttachmentPlane=PlaneXY(0, 0, 0),
    ToolPlane=rotate_3d_11.Geometry,
    LoadData=load_data_2)

# ---- group: Torch Definition
unclose_geometry_2 = Brep([<brep referenced from the Rhino model> x11])
load_data_3 = LoadData(Mass="5.6")

# ---- group: Torch Definition / Close Gripper
mesh_brep_3 = MeshBrep(
    Brep=unclose_geometry_2,
    Settings={GridMaxCount=0, GridMinCount=16, JaggedSeams=False, MaxEdgeLength=0, MinEdgeLength=0.0001, MinTolerance=0, Refine=True, RefineAngle=0, RelativeTolerance=0.65, SimplePlanes=True, Tolerance=0})
mesh_3 = Mesh(mesh_brep_3)
mesh_join_3 = MeshJoin(Meshes=mesh_3)

# ---- group: Torch Definition (continued)
robot_tool_4 = RobotTool(Name="Torch", Mesh=mesh_join_3, AttachmentPlane=PlaneXY(0, 0, 0), ToolPlane=rotate_3d_6.Geometry, LoadData=load_data_3)

# ----
robot_tool_5 = RobotTool(robot_tool_4)

robot_joint_position_2 = RobotJointPosition(
    RobotJointPosition1=0,
    RobotJointPosition2=1.570796327,
    RobotJointPosition3=0,
    RobotJointPosition4=0,
    RobotJointPosition5=0,
    RobotJointPosition6=0)
joint_target_2 = JointTarget(RobotJointPosition=robot_joint_position_2)
list_31 = ValueList({"v5": 5, "v10": 10, "v20": 20, "v30": 30, "v40": 40, "v50": 50, "v60": 60, "v80": 80, "v100": 100, "v150": 150, "v200": 200, "v300": 300, "v400": 400, "v500": 500, "v600": 600, "v800": 800, "v1000": 1000, "v1500": 1500, "v2000": 2000, "v2500": 2500, "v3000": 3000, "v4000": 4000, "v5000": 5000, "v6000": 6000, "v7000": 7000}, selected="v200")
list_32 = ValueList({"z0": 0, "z1": 1, "z5": 5, "z10": 10, "z15": 15, "z20": 20, "z30": 30, "z40": 40, "z50": 50, "z60": 60, "z80": 80, "z100": 100, "z150": 150, "z200": 200, "fine": -1}, selected="fine")
list_33 = ValueList({"MoveAbsJ": 0, "MoveL": 1, "MoveJ": 2, "MoveC": 3}, selected="MoveAbsJ")
move_14 = Move(
    Type=list_33,
    Target=joint_target_2,
    SpeedData=list_31,
    ZoneData=list_32,
    RobotTool=robot_tool_5,
    Override_Robot_Tool=True,
    Override_Work_Object=True,
    Set_Circular_Point=False,
    Set_Digital_Output=False,
    Set_Movement_Time=False)

series_15 = Series(Start=49, Step=50, Count=3)
series_16 = Series(Start=49, Step=50, Count=4)
list_item_8 = ListItem(List=move.Geometry, Index=series_15, Wrap=True)
unit_z_5 = UnitZ(Factor="50")
list_item_9 = ListItem(List=move_3.Geometry, Index=series_16, Wrap=True)
unit_z_6 = UnitZ(Factor="50")
move_15 = Move(Geometry=list_item_8, Motion=unit_z_5)  # -> Geometry, Transform
move_16 = Move(Geometry=list_item_9, Motion=unit_z_6)  # -> Geometry, Transform
list_item_10 = ListItem(List=insert_items, Index=Slider(99, range=0..100), Wrap=True)
list_item_11 = ListItem(List=xy_plane_7, Index=Slider(399, range=0..1000), Wrap=True)
xy_plane_12 = XYPlane(Origin=move_15.Geometry)
xy_plane_13 = XYPlane(Origin=move_16.Geometry)
panel_6 = Panel("""0
2
4""")
panel_7 = Panel("""0
2
4""")
partition_list = PartitionList(List=xy_plane_6, Size="100")  # -> simplify(Chunks)
partition_list_2 = PartitionList(List=xy_plane_7, Size="100")  # -> simplify(Chunks)
insert_items_11 = InsertItems(List=xy_plane_9, Item=flip_plane_6, Indices=panel_6, Wrap=True)
explode_tree = ExplodeTree(Data=partition_list_2)  # -> Branch0, Branch1, Branch2, Branch3
series_17 = Series(Start=0, Step=100, Count=7)
series_18 = Series(Start=101, Step=101, Count=7)

flip_plane_7 = FlipPlane(Plane=xy_plane_12, ReverseX=True, ReverseY=False, SwapAxes=True)
flip_plane_8 = FlipPlane(Plane=partition_list, ReverseX=True, ReverseY=False, SwapAxes=True)
list_item_12 = ListItem(List=insert_items_11, Index=Slider(6, range=0..10), Wrap=True)
robot_target_7 = RobotTarget(Plane=insert_items_11, ReferencePlane=work_object, Set_External_Joint_Position=False, Set_Reference_Plane=True)
move_17 = Move(
    Type=list_22,
    Target=robot_target_7,
    SpeedData=list_23,
    ZoneData=list_24,
    RobotTool=robot_tool_5,
    WorkObject=work_object,
    Override_Robot_Tool=True,
    Override_Work_Object=True,
    Set_Circular_Point=False,
    Set_Digital_Output=False,
    Set_Movement_Time=False)

insert_items_12 = InsertItems(List=xy_plane_13, Item=flip_plane_7, Indices=panel_7, Wrap=True)
explode_tree_2 = ExplodeTree(Data=flip_plane_8)  # -> Branch0, Branch1, Branch2
merge = Merge(
    Data1=explode_tree_2.Branch0,
    Data2=explode_tree.Branch0,
    Data3=explode_tree.Branch1,
    Data4=explode_tree_2.Branch1,
    Data5=explode_tree.Branch2,
    Data6=explode_tree.Branch3)  # -> flatten(Result)

list_item_13 = ListItem(List=insert_items_12, Index=Slider(0, range=0..10), Wrap=True)
robot_target_8 = RobotTarget(Plane=insert_items_12, ReferencePlane=work_object, Set_External_Joint_Position=False, Set_Reference_Plane=True)
merge_2 = Merge(Data1=merge, Data2=explode_tree_2.Branch2)  # -> flatten(Result)
robot_target_9 = RobotTarget(Plane=merge_2, ReferencePlane=work_object, Set_External_Joint_Position=False, Set_Reference_Plane=True)
move_18 = Move(
    Type=list_25,
    Target=robot_target_8,
    SpeedData=list_26,
    ZoneData=list_27,
    RobotTool=robot_tool_5,
    WorkObject=work_object,
    Override_Robot_Tool=True,
    Override_Work_Object=True,
    Set_Circular_Point=False,
    Set_Digital_Output=False,
    Set_Movement_Time=False)
move_19 = Move(
    Type=list_28,
    Target=robot_target_9,
    SpeedData=list_29,
    ZoneData=list_30,
    RobotTool=robot_tool_5,
    WorkObject=work_object,
    Override_Robot_Tool=True,
    Override_Work_Object=True,
    Set_Circular_Point=False,
    Set_Digital_Output=False,
    Set_Movement_Time=False)

insert_items_13 = InsertItems(List=move_19, Item=move_17, Indices=series_17, Wrap=True)
insert_items_14 = InsertItems(List=insert_items_13, Item=move_18, Indices=series_18, Wrap=True)
merge_3 = Merge(Data1=flatten(move_14), Data2=flatten(insert_items_14), Data3=flatten(move_14))

merge_4 = Merge(Data1=flatten(insert_items_10), Data2=flatten(merge_3))

rapid_generator = RAPIDGenerator(
    Robot=robot_preset,
    Action=merge_4,
    Add_loaddata=False,
    Add_tooldata=False,
    Add_wobjdata=False,
    Module_Name=False,
    Output_loaddata=False,
    Output_tooldata=False,
    Output_wobjdata=False,
    Routine_Name=False)
panel_8 = Panel(rapid_generator)
