# Grasshopper definition PickPlace_RobotComponent.gh (Grasshopper 1.0.8)
# plug-ins: Robot Components

tcp_unclose = Point(<point referenced from the Rhino model>)
xy_plane = XYPlane(Origin=tcp_unclose)
unclose_geometry = Brep([<brep referenced from the Rhino model> x8])
mesh_brep = MeshBrep(
    Brep=unclose_geometry,
    Settings={GridMaxCount=0, GridMinCount=16, JaggedSeams=False, MaxEdgeLength=0, MinEdgeLength=0.0001, MinTolerance=0, Refine=True, RefineAngle=0, RelativeTolerance=0.65, SimplePlanes=True, Tolerance=0})
deconstruct_plane = DeconstructPlane(Plane=xy_plane)  # -> Origin, XAxis, YAxis, ZAxis
mesh = Mesh(mesh_brep)
deconstruct_plane_2 = DeconstructPlane(Plane=xy_plane)  # -> Origin, XAxis, YAxis, ZAxis
deconstruct_plane_3 = DeconstructPlane(Plane=xy_plane)  # -> Origin, XAxis, YAxis, ZAxis
mesh_join = MeshJoin(Meshes=mesh)
rotate_3d = Rotate3D(Geometry=xy_plane, Angle=degrees(Slider(0, range=0..100)), Center=deconstruct_plane.Origin, Axis=deconstruct_plane.XAxis)  # -> Geometry, Transform
rotate_3d_2 = Rotate3D(
    Geometry=rotate_3d.Geometry,
    Angle=degrees(Slider(0, range=0..100)),
    Center=deconstruct_plane_2.Origin,
    Axis=deconstruct_plane_2.YAxis)  # -> Geometry, Transform
rotate_3d_3 = Rotate3D(
    Geometry=rotate_3d_2.Geometry,
    Angle=degrees(Slider(0, range=0..100)),
    Center=deconstruct_plane_3.Origin,
    Axis=deconstruct_plane_3.ZAxis)  # -> Geometry, Transform
load_data = LoadData(Mass="5.6")
robot_tool = RobotTool(
    Name="GripperUnclose",
    Mesh=mesh_join,
    AttachmentPlane=PlaneXY(0, 0, 0),
    ToolPlane=rotate_3d_3.Geometry,
    LoadData=load_data)

brep = Brep([<brep referenced from the Rhino model> x8])

# ---- group: Gripper Close
tcp_close = Point(<point referenced from the Rhino model>)
xy_plane_2 = XYPlane(Origin=tcp_close)
mesh_brep_2 = MeshBrep(
    Brep=brep,
    Settings={GridMaxCount=0, GridMinCount=16, JaggedSeams=False, MaxEdgeLength=0, MinEdgeLength=0.0001, MinTolerance=0, Refine=True, RefineAngle=0, RelativeTolerance=0.65, SimplePlanes=True, Tolerance=0})
deconstruct_plane_4 = DeconstructPlane(Plane=xy_plane_2)  # -> Origin, XAxis, YAxis, ZAxis
# Tool center point parametrization and Tool integration
mesh_2 = Mesh(mesh_brep_2)
deconstruct_plane_5 = DeconstructPlane(Plane=xy_plane_2)  # -> Origin, XAxis, YAxis, ZAxis
deconstruct_plane_6 = DeconstructPlane(Plane=xy_plane_2)  # -> Origin, XAxis, YAxis, ZAxis
mesh_join_2 = MeshJoin(Meshes=mesh_2)
rotate_3d_4 = Rotate3D(
    Geometry=xy_plane_2,
    Angle=degrees(Slider(0, range=0..100)),
    Center=deconstruct_plane_4.Origin,
    Axis=deconstruct_plane_4.XAxis)  # -> Geometry, Transform
rotate_3d_5 = Rotate3D(
    Geometry=rotate_3d_4.Geometry,
    Angle=degrees(Slider(0, range=0..100)),
    Center=deconstruct_plane_5.Origin,
    Axis=deconstruct_plane_5.YAxis)  # -> Geometry, Transform
rotate_3d_6 = Rotate3D(
    Geometry=rotate_3d_5.Geometry,
    Angle=degrees(Slider(0, range=0..100)),
    Center=deconstruct_plane_6.Origin,
    Axis=deconstruct_plane_6.ZAxis)  # -> Geometry, Transform
load_data_2 = LoadData(Mass="5.6")
robot_tool_2 = RobotTool(
    Name="GripperClose",
    Mesh=mesh_join_2,
    AttachmentPlane=PlaneXY(0, 0, 0),
    ToolPlane=rotate_3d_6.Geometry,
    LoadData=load_data_2)

# ----
point = Point(<point referenced from the Rhino model>)
# WobjData for bricks and Table
point_2 = Point(<point referenced from the Rhino model>)
xy_plane_3 = XYPlane(Origin=point_2)
xy_plane_4 = XYPlane(Origin=point)
work_object = WorkObject(Name="TableFrame", Plane=xy_plane_3)
work_object_2 = WorkObject(Name="BrickFrame", Plane=xy_plane_4)

# ---- group: Bricks plane creation
brep_2 = Brep([<brep referenced from the Rhino model> x8])
list_length = ListLength(List=brep_2)
deconstruct_brep = DeconstructBrep(Brep=brep_2)  # -> flatten(Faces), Edges, Vertices
series = Series(Start=2, Step=6, Count=list_length)
list_item = ListItem(List=deconstruct_brep.Faces, Index=series, Wrap=True)
polygon_center = PolygonCenter(Polyline=list_item)  # -> CenterV, CenterE, CenterA
construct_plane = ConstructPlane(Origin=polygon_center.CenterV, XAxis=Vector(1, 0, 0), YAxis=Vector(0, 1, 0))
unit_z = UnitZ(Factor="200")
flip_plane = FlipPlane(Plane=construct_plane, ReverseX=False, ReverseY=False, SwapAxes=True)
plane_offset = PlaneOffset(BasePlane=construct_plane, Offset=unit_z)
flip_plane_2 = FlipPlane(Plane=plane_offset, ReverseX=False, ReverseY=False, SwapAxes=True)

# ---- group: Table Plane Creation
subtraction = Subtraction(A=list_length, B=1)
curve = Curve(<curve referenced from the Rhino model>)
divide_curve = DivideCurve(Curve=curve, Count=subtraction, Kinks=False)  # -> Points, Tangents, Parameters
xy_plane_5 = XYPlane(Origin=divide_curve.Points)
unit_z_2 = UnitZ(Factor="200")
flip_plane_3 = FlipPlane(Plane=xy_plane_5, ReverseX=False, ReverseY=False, SwapAxes=True)
plane_offset_2 = PlaneOffset(BasePlane=xy_plane_5, Offset=unit_z_2)
flip_plane_4 = FlipPlane(Plane=plane_offset_2, ReverseX=False, ReverseY=False, SwapAxes=True)

# ----
# Table and Bricks plane definition
deconstruct_plane_7 = DeconstructPlane(Plane=flip_plane)  # -> Origin, XAxis, YAxis, ZAxis
multiplication = Multiplication(A=deconstruct_plane_7.ZAxis, B=Slider(200, range=0..1000))
deconstruct_plane_8 = DeconstructPlane(Plane=flip_plane_2)  # -> Origin, XAxis, YAxis, ZAxis
vector_display = VectorDisplay(Anchor=deconstruct_plane_7.Origin, Vector=multiplication)
rotate_3d_7 = Rotate3D(
    Geometry=flip_plane,
    Angle=degrees(Slider(90, range=-180..180)),
    Center=deconstruct_plane_7.Origin,
    Axis=deconstruct_plane_7.ZAxis)  # -> Geometry, Transform
rotate_3d_8 = Rotate3D(
    Geometry=flip_plane_2,
    Angle=degrees(Slider(90, range=-180..180)),
    Center=deconstruct_plane_8.Origin,
    Axis=deconstruct_plane_8.ZAxis)  # -> Geometry, Transform

robot_joint_position = RobotJointPosition(
    RobotJointPosition1=0,
    RobotJointPosition2=1.570796327,
    RobotJointPosition3=0,
    RobotJointPosition4=0,
    RobotJointPosition5=0,
    RobotJointPosition6=0)
joint_target = JointTarget(RobotJointPosition=robot_joint_position)
robot_target = RobotTarget(Plane=rotate_3d_7.Geometry, ReferencePlane=work_object_2, Set_External_Joint_Position=False, Set_Reference_Plane=True)
robot_target_2 = RobotTarget(Plane=flip_plane_4, ReferencePlane=work_object, Set_External_Joint_Position=False, Set_Reference_Plane=True)
robot_target_3 = RobotTarget(Plane=flip_plane_3, ReferencePlane=work_object, Set_External_Joint_Position=False, Set_Reference_Plane=True)
robot_target_4 = RobotTarget(Plane=rotate_3d_8.Geometry, ReferencePlane=work_object_2, Set_External_Joint_Position=False, Set_Reference_Plane=True)
robot_target_5 = RobotTarget(Plane=rotate_3d_8.Geometry, ReferencePlane=work_object_2, Set_External_Joint_Position=False, Set_Reference_Plane=True)
robot_target_6 = RobotTarget(Plane=flip_plane_4, ReferencePlane=work_object, Set_External_Joint_Position=False, Set_Reference_Plane=True)
list_length_2 = ListLength(List=rotate_3d_8.Geometry)
list = ValueList({"v5": 5, "v10": 10, "v20": 20, "v30": 30, "v40": 40, "v50": 50, "v60": 60, "v80": 80, "v100": 100, "v150": 150, "v200": 200, "v300": 300, "v400": 400, "v500": 500, "v600": 600, "v800": 800, "v1000": 1000, "v1500": 1500, "v2000": 2000, "v2500": 2500, "v3000": 3000, "v4000": 4000, "v5000": 5000, "v6000": 6000, "v7000": 7000}, selected="v200")
list_2 = ValueList({"z0": 0, "z1": 1, "z5": 5, "z10": 10, "z15": 15, "z20": 20, "z30": 30, "z40": 40, "z50": 50, "z60": 60, "z80": 80, "z100": 100, "z150": 150, "z200": 200, "fine": -1}, selected="fine")
list_3 = ValueList({"MoveAbsJ": 0, "MoveL": 1, "MoveJ": 2, "MoveC": 3}, selected="MoveAbsJ")
list_4 = ValueList({"MoveAbsJ": 0, "MoveL": 1, "MoveJ": 2, "MoveC": 3}, selected="MoveJ")
list_5 = ValueList({"MoveAbsJ": 0, "MoveL": 1, "MoveJ": 2, "MoveC": 3}, selected="MoveL")
list_6 = ValueList({"MoveAbsJ": 0, "MoveL": 1, "MoveJ": 2, "MoveC": 3}, selected="MoveJ")
list_7 = ValueList({"MoveAbsJ": 0, "MoveL": 1, "MoveJ": 2, "MoveC": 3}, selected="MoveL")
list_8 = ValueList({"v5": 5, "v10": 10, "v20": 20, "v30": 30, "v40": 40, "v50": 50, "v60": 60, "v80": 80, "v100": 100, "v150": 150, "v200": 200, "v300": 300, "v400": 400, "v500": 500, "v600": 600, "v800": 800, "v1000": 1000, "v1500": 1500, "v2000": 2000, "v2500": 2500, "v3000": 3000, "v4000": 4000, "v5000": 5000, "v6000": 6000, "v7000": 7000}, selected="v200")
list_9 = ValueList({"v5": 5, "v10": 10, "v20": 20, "v30": 30, "v40": 40, "v50": 50, "v60": 60, "v80": 80, "v100": 100, "v150": 150, "v200": 200, "v300": 300, "v400": 400, "v500": 500, "v600": 600, "v800": 800, "v1000": 1000, "v1500": 1500, "v2000": 2000, "v2500": 2500, "v3000": 3000, "v4000": 4000, "v5000": 5000, "v6000": 6000, "v7000": 7000}, selected="v50")
list_10 = ValueList({"v5": 5, "v10": 10, "v20": 20, "v30": 30, "v40": 40, "v50": 50, "v60": 60, "v80": 80, "v100": 100, "v150": 150, "v200": 200, "v300": 300, "v400": 400, "v500": 500, "v600": 600, "v800": 800, "v1000": 1000, "v1500": 1500, "v2000": 2000, "v2500": 2500, "v3000": 3000, "v4000": 4000, "v5000": 5000, "v6000": 6000, "v7000": 7000}, selected="v200")
list_11 = ValueList({"v5": 5, "v10": 10, "v20": 20, "v30": 30, "v40": 40, "v50": 50, "v60": 60, "v80": 80, "v100": 100, "v150": 150, "v200": 200, "v300": 300, "v400": 400, "v500": 500, "v600": 600, "v800": 800, "v1000": 1000, "v1500": 1500, "v2000": 2000, "v2500": 2500, "v3000": 3000, "v4000": 4000, "v5000": 5000, "v6000": 6000, "v7000": 7000}, selected="v50")
list_12 = ValueList({"MoveAbsJ": 0, "MoveL": 1, "MoveJ": 2, "MoveC": 3}, selected="MoveL")
list_13 = ValueList({"MoveAbsJ": 0, "MoveL": 1, "MoveJ": 2, "MoveC": 3}, selected="MoveL")
list_14 = ValueList({"v5": 5, "v10": 10, "v20": 20, "v30": 30, "v40": 40, "v50": 50, "v60": 60, "v80": 80, "v100": 100, "v150": 150, "v200": 200, "v300": 300, "v400": 400, "v500": 500, "v600": 600, "v800": 800, "v1000": 1000, "v1500": 1500, "v2000": 2000, "v2500": 2500, "v3000": 3000, "v4000": 4000, "v5000": 5000, "v6000": 6000, "v7000": 7000}, selected="v50")
list_15 = ValueList({"v5": 5, "v10": 10, "v20": 20, "v30": 30, "v40": 40, "v50": 50, "v60": 60, "v80": 80, "v100": 100, "v150": 150, "v200": 200, "v300": 300, "v400": 400, "v500": 500, "v600": 600, "v800": 800, "v1000": 1000, "v1500": 1500, "v2000": 2000, "v2500": 2500, "v3000": 3000, "v4000": 4000, "v5000": 5000, "v6000": 6000, "v7000": 7000}, selected="v50")
list_16 = ValueList({"z0": 0, "z1": 1, "z5": 5, "z10": 10, "z15": 15, "z20": 20, "z30": 30, "z40": 40, "z50": 50, "z60": 60, "z80": 80, "z100": 100, "z150": 150, "z200": 200, "fine": -1}, selected="fine")
list_17 = ValueList({"z0": 0, "z1": 1, "z5": 5, "z10": 10, "z15": 15, "z20": 20, "z30": 30, "z40": 40, "z50": 50, "z60": 60, "z80": 80, "z100": 100, "z150": 150, "z200": 200, "fine": -1}, selected="fine")
list_18 = ValueList({"z0": 0, "z1": 1, "z5": 5, "z10": 10, "z15": 15, "z20": 20, "z30": 30, "z40": 40, "z50": 50, "z60": 60, "z80": 80, "z100": 100, "z150": 150, "z200": 200, "fine": -1}, selected="fine")
list_19 = ValueList({"z0": 0, "z1": 1, "z5": 5, "z10": 10, "z15": 15, "z20": 20, "z30": 30, "z40": 40, "z50": 50, "z60": 60, "z80": 80, "z100": 100, "z150": 150, "z200": 200, "fine": -1}, selected="fine")
list_20 = ValueList({"z0": 0, "z1": 1, "z5": 5, "z10": 10, "z15": 15, "z20": 20, "z30": 30, "z40": 40, "z50": 50, "z60": 60, "z80": 80, "z100": 100, "z150": 150, "z200": 200, "fine": -1}, selected="fine")
list_21 = ValueList({"z0": 0, "z1": 1, "z5": 5, "z10": 10, "z15": 15, "z20": 20, "z30": 30, "z40": 40, "z50": 50, "z60": 60, "z80": 80, "z100": 100, "z150": 150, "z200": 200, "fine": -1}, selected="fine")
# Table and Bricks Action Definition
move = Move(
    Type=list_3,
    Target=joint_target,
    SpeedData=list,
    ZoneData=list_2,
    Override_Robot_Tool=False,
    Override_Work_Object=True,
    Set_Circular_Point=False,
    Set_Digital_Output=False,
    Set_Movement_Time=False)
move_2 = Move(
    Type=list_4,
    Target=robot_target_2,
    SpeedData=list_8,
    ZoneData=list_16,
    WorkObject=work_object,
    Override_Robot_Tool=False,
    Override_Work_Object=True,
    Set_Circular_Point=False,
    Set_Digital_Output=False,
    Set_Movement_Time=False)
move_3 = Move(
    Type=list_5,
    Target=robot_target_3,
    SpeedData=list_9,
    ZoneData=list_17,
    WorkObject=work_object,
    Override_Robot_Tool=False,
    Override_Work_Object=True,
    Set_Circular_Point=False,
    Set_Digital_Output=False,
    Set_Movement_Time=False)
move_4 = Move(
    Type=list_6,
    Target=robot_target_4,
    SpeedData=list_10,
    ZoneData=list_18,
    WorkObject=work_object_2,
    Override_Robot_Tool=False,
    Override_Work_Object=True,
    Set_Circular_Point=False,
    Set_Digital_Output=False,
    Set_Movement_Time=False)
move_5 = Move(
    Type=list_7,
    Target=robot_target_5,
    SpeedData=list_11,
    ZoneData=list_19,
    WorkObject=work_object_2,
    Override_Robot_Tool=False,
    Override_Work_Object=True,
    Set_Circular_Point=False,
    Set_Digital_Output=False,
    Set_Movement_Time=False)
move_6 = Move(
    Type=list_12,
    Target=robot_target_6,
    SpeedData=list_15,
    ZoneData=list_20,
    WorkObject=work_object,
    Override_Robot_Tool=False,
    Override_Work_Object=True,
    Set_Circular_Point=False,
    Set_Digital_Output=False,
    Set_Movement_Time=False)
move_7 = Move(
    Type=list_13,
    Target=robot_target,
    SpeedData=list_14,
    ZoneData=list_21,
    WorkObject=work_object_2,
    Override_Robot_Tool=False,
    Override_Work_Object=True,
    Set_Circular_Point=False,
    Set_Digital_Output=False,
    Set_Movement_Time=False)
series_2 = Series(Start=0, Step=1, Count=8)
insert_items = InsertItems(List=move_4, Item=move, Indices=series_2, Wrap=True)
series_3 = Series(Start=2, Step=2, Count=list_length_2)
series_4 = Series(Start=3, Step=3, Count=list_length_2)
insert_items_2 = InsertItems(List=insert_items, Item=move_7, Indices=series_3, Wrap=True)
series_5 = Series(Start=4, Step=4, Count=list_length_2)
insert_items_3 = InsertItems(List=insert_items_2, Item=move_5, Indices=series_4, Wrap=True)
series_6 = Series(Start=5, Step=5, Count=list_length_2)
insert_items_4 = InsertItems(List=insert_items_3, Item=move, Indices=series_5, Wrap=True)
series_7 = Series(Start=6, Step=6, Count=list_length_2)
insert_items_5 = InsertItems(List=insert_items_4, Item=move_2, Indices=series_6, Wrap=True)
series_8 = Series(Start=7, Step=7, Count=list_length_2)
insert_items_6 = InsertItems(List=insert_items_5, Item=move_3, Indices=series_7, Wrap=True)
series_9 = Series(Start=8, Step=8, Count=list_length_2)
insert_items_7 = InsertItems(List=insert_items_6, Item=move_6, Indices=series_8, Wrap=True)
insert_items_8 = InsertItems(List=insert_items_7, Item=move, Indices=series_9, Wrap=True)

xy_plane_6 = XYPlane(Origin=Point(0, 0, 0))
plane_offset_3 = PlaneOffset(BasePlane=xy_plane_6, Offset="500")
# Code generation and Simulation
robot_preset = RobotPreset(PositionPlane=plane_offset_3, RobotTool=robot_tool, Robot_Preset_Number=19)

rapid_generator = RAPIDGenerator(
    Robot=robot_preset,
    Action=insert_items_8,
    Add_loaddata=False,
    Add_tooldata=False,
    Add_wobjdata=False,
    Module_Name=False,
    Output_loaddata=False,
    Output_tooldata=False,
    Output_wobjdata=False,
    Routine_Name=False)
panel = Panel(rapid_generator)

number_slider = Slider(0, range=0..1)
path_generator = PathGenerator(
    Robot=robot_preset,
    Action=insert_items_8,
    Interpolations=Slider(132, range=0..1000),
    AnimationSlider=Slider(0, range=0..1),
    Update=True,
    Output_Error_Messages=True,
    Output_External_Axis_Planes=False,
    Output_External_Joint_Position=False,
    Output_External_Joint_Positions=False,
    Output_Movement=False,
    Output_Movements=False,
    Output_Path=True,
    Output_Posed_Meshes=False,
    Output_Robot_End_Plane=False,
    Output_Robot_End_Planes=False,
    Output_Robot_Joint_Position=False,
    Output_Robot_Joint_Positions=False,
    Preview_Path=True,
    Preview_Posed_Meshes=True)  # -> Path, ErrorMessages
panel_2 = Panel(path_generator.ErrorMessages)
