# Grasshopper definition PickPlace_Robot.gh (Grasshopper 1.0.8)
# plug-ins: RhinoCodePluginGH, Robots

# ---- group: Gripper Unclose / TCP orientation setup
tcp_unclose = Point(<point referenced from the Rhino model>)
xy_plane = XYPlane(Origin=tcp_unclose)
deconstruct_plane = DeconstructPlane(Plane=xy_plane)  # -> Origin, XAxis, YAxis, ZAxis
deconstruct_plane_2 = DeconstructPlane(Plane=xy_plane)  # -> Origin, XAxis, YAxis, ZAxis
deconstruct_plane_3 = DeconstructPlane(Plane=xy_plane)  # -> Origin, XAxis, YAxis, ZAxis
rotate_3d = Rotate3D(Geometry=xy_plane, Angle=degrees(Slider(0, range=0..100)), Center=deconstruct_plane.Origin, Axis=deconstruct_plane.XAxis)  # -> Geometry, Transform
rotate_3d_2 = Rotate3D(
    Geometry=rotate_3d.Geometry,
    Angle=degrees(Slider(0, range=0..100)),
    Center=deconstruct_plane_2.Origin,
    Axis=deconstruct_plane_2.YAxis)  # -> Geometry, Transform
rotate_3d_3 = Rotate3D(
    Geometry=rotate_3d_2.Geometry,
    Angle=degrees(Slider(0, range=0..100)),
    Center=deconstruct_plane_3.Origin,
    Axis=deconstruct_plane_3.ZAxis)  # -> Geometry, Transform

# ---- group: Gripper Close / TCP orientation setup
tcp_close = Point(<point referenced from the Rhino model>)
xy_plane_2 = XYPlane(Origin=tcp_close)
deconstruct_plane_4 = DeconstructPlane(Plane=xy_plane_2)  # -> Origin, XAxis, YAxis, ZAxis
deconstruct_plane_5 = DeconstructPlane(Plane=xy_plane_2)  # -> Origin, XAxis, YAxis, ZAxis
deconstruct_plane_6 = DeconstructPlane(Plane=xy_plane_2)  # -> Origin, XAxis, YAxis, ZAxis
rotate_3d_4 = Rotate3D(
    Geometry=xy_plane_2,
    Angle=degrees(Slider(0, range=0..100)),
    Center=deconstruct_plane_4.Origin,
    Axis=deconstruct_plane_4.XAxis)  # -> Geometry, Transform
rotate_3d_5 = Rotate3D(
    Geometry=rotate_3d_4.Geometry,
    Angle=degrees(Slider(0, range=0..100)),
    Center=deconstruct_plane_5.Origin,
    Axis=deconstruct_plane_5.YAxis)  # -> Geometry, Transform
rotate_3d_6 = Rotate3D(
    Geometry=rotate_3d_5.Geometry,
    Angle=degrees(Slider(0, range=0..100)),
    Center=deconstruct_plane_6.Origin,
    Axis=deconstruct_plane_6.ZAxis)  # -> Geometry, Transform

# ---- group: Bricks plane creation
brep = Brep([<brep referenced from the Rhino model> x8])
list_length = ListLength(List=brep)
deconstruct_brep = DeconstructBrep(Brep=brep)  # -> flatten(Faces), Edges, Vertices
series = Series(Start=2, Step=6, Count=list_length)
list_item = ListItem(List=deconstruct_brep.Faces, Index=series, Wrap=True)
polygon_center = PolygonCenter(Polyline=list_item)  # -> CenterV, CenterE, CenterA
construct_plane = ConstructPlane(Origin=polygon_center.CenterV, XAxis=Vector(1, 0, 0), YAxis=Vector(0, 1, 0))
unit_z = UnitZ(Factor="200")
flip_plane = FlipPlane(Plane=construct_plane, ReverseX=False, ReverseY=False, SwapAxes=True)
plane_offset = PlaneOffset(BasePlane=construct_plane, Offset=unit_z)
flip_plane_2 = FlipPlane(Plane=plane_offset, ReverseX=False, ReverseY=False, SwapAxes=True)

# ----
brep_2 = Brep([<brep referenced from the Rhino model> x8])
unclose_geometry = Brep([<brep referenced from the Rhino model> x8])

# ---- group: Gripper Close / Close Gripper
mesh_brep = MeshBrep(
    Brep=brep_2,
    Settings={GridMaxCount=0, GridMinCount=16, JaggedSeams=False, MaxEdgeLength=0, MinEdgeLength=0.0001, MinTolerance=0, Refine=True, RefineAngle=0, RelativeTolerance=0.65, SimplePlanes=True, Tolerance=0})
mesh = Mesh(mesh_brep)
mesh_join = MeshJoin(Meshes=mesh)

# ---- group: Gripper Unclose / Close Gripper
mesh_brep_2 = MeshBrep(
    Brep=unclose_geometry,
    Settings={GridMaxCount=0, GridMinCount=16, JaggedSeams=False, MaxEdgeLength=0, MinEdgeLength=0.0001, MinTolerance=0, Refine=True, RefineAngle=0, RelativeTolerance=0.65, SimplePlanes=True, Tolerance=0})
mesh_2 = Mesh(mesh_brep_2)
mesh_join_2 = MeshJoin(Meshes=mesh_2)

# ---- group: Table Plane Creation
subtraction = Subtraction(A=list_length, B=1)
curve = Curve(<curve referenced from the Rhino model>)
divide_curve = DivideCurve(Curve=curve, Count=subtraction, Kinks=False)  # -> Points, Tangents, Parameters
xy_plane_3 = XYPlane(Origin=divide_curve.Points)
unit_z_2 = UnitZ(Factor="200")
flip_plane_3 = FlipPlane(Plane=xy_plane_3, ReverseX=False, ReverseY=False, SwapAxes=True)
plane_offset_2 = PlaneOffset(BasePlane=xy_plane_3, Offset=unit_z_2)
flip_plane_4 = FlipPlane(Plane=plane_offset_2, ReverseX=False, ReverseY=False, SwapAxes=True)

# ---- group: Gripper Close
create_tool = CreateTool(Name="GripperClose", TCP=rotate_3d_6.Geometry, Weight="5.6", Mesh=mesh_join)  # -> Tool, TCP

# ---- group: Gripper Unclose
create_tool_2 = CreateTool(Name="GripperUnclose", TCP=rotate_3d_3.Geometry, Weight="5.6", Mesh=mesh_join_2)  # -> Tool, TCP

# ----
deconstruct_plane_7 = DeconstructPlane(Plane=flip_plane)  # -> Origin, XAxis, YAxis, ZAxis

# ---- group: Home position close gripper Target
joint_configuration = Panel("0,pi/2,0,0,0,0")
speed_mm_s = Panel("100")
zone_mm = Panel("0")
joints_parameter = JointsParameter(joint_configuration)
speed_parameter = SpeedParameter(speed_mm_s)
create_target = CreateTarget(Joints=joints_parameter, Tool=create_tool.Tool, Speed=speed_parameter, Zone=zone_mm, IsCartesian=False)

# ----
panel = Panel("""SetDO out1, 0;
SetDO out2, 0;""")
deconstruct_plane_8 = DeconstructPlane(Plane=flip_plane_2)  # -> Origin, XAxis, YAxis, ZAxis
multiplication = Multiplication(A=deconstruct_plane_7.ZAxis, B=Slider(200, range=0..1000))
rotate_3d_7 = Rotate3D(
    Geometry=flip_plane,
    Angle=degrees(Slider(90, range=-180..180)),
    Center=deconstruct_plane_7.Origin,
    Axis=deconstruct_plane_7.ZAxis)  # -> Geometry, Transform
custom_command = CustomCommand(Name="GripperSignalZero", Manufacturer="All", Code=panel)

# ---- group: Home position unclose Target
joint_configuration_2 = Panel("0,pi/2,0,0,0,0")
speed_mm_s_2 = Panel("100")
zone_mm_2 = Panel("0")
joints_parameter_2 = JointsParameter(joint_configuration_2)
speed_parameter_2 = SpeedParameter(speed_mm_s_2)
create_target_2 = CreateTarget(
    Joints=joints_parameter_2,
    Tool=create_tool_2.Tool,
    Speed=speed_parameter_2,
    Zone=zone_mm_2,
    Command=custom_command,
    IsCartesian=False)

# ----
vector_display = VectorDisplay(Anchor=deconstruct_plane_7.Origin, Vector=multiplication)
rotate_3d_8 = Rotate3D(
    Geometry=flip_plane_2,
    Angle=degrees(Slider(90, range=-180..180)),
    Center=deconstruct_plane_8.Origin,
    Axis=deconstruct_plane_8.ZAxis)  # -> Geometry, Transform

# ---- group: A - Target definition
point = Point(<point referenced from the Rhino model>)
point_2 = Point(<point referenced from the Rhino model>)
unit_z_3 = UnitZ(Factor="30")
out1 = Panel("0")
out1_2 = Panel("0")
xy_plane_4 = XYPlane(Origin=point_2)
xy_plane_5 = XYPlane(Origin=point)
unit_z_4 = UnitZ(Factor="30")
set_do = SetDO(DO=out1, Value=True)
flip_plane_5 = FlipPlane(Plane=xy_plane_4, ReverseX=False, ReverseY=False, SwapAxes=True)
wait = Wait(Time="2")
set_do_2 = SetDO(DO=out1_2, Value=True)
plane_offset_3 = PlaneOffset(BasePlane=xy_plane_4, Offset=unit_z_3)
wait_2 = Wait(Time="2")
plane_offset_4 = PlaneOffset(BasePlane=xy_plane_5, Offset=unit_z_4)
merge = Merge(Data1=set_do, Data2=wait)
flip_plane_6 = FlipPlane(Plane=xy_plane_5, ReverseX=False, ReverseY=False, SwapAxes=True)
merge_2 = Merge(Data1=set_do_2, Data2=wait_2)
flip_plane_7 = FlipPlane(Plane=plane_offset_3, ReverseX=False, ReverseY=False, SwapAxes=True)
flip_plane_8 = FlipPlane(Plane=plane_offset_4, ReverseX=False, ReverseY=False, SwapAxes=True)
list = ValueList({"Joint", "Linear"}, selected="Linear")
list_2 = ValueList({"Joint", "Linear"}, selected="Linear")
list_3 = ValueList({"Joint", "Linear"}, selected="Joint")
list_4 = ValueList({"Joint", "Linear"}, selected="Linear")
list_5 = ValueList({"Joint", "Linear"}, selected="Joint")
create_target_3 = CreateTarget(Plane=flip_plane_7, Motion=list, Tool=create_tool.Tool, Speed=Slider(10, range=0..1000), IsCartesian=True)
create_target_4 = CreateTarget(
    Plane=flip_plane_5,
    Motion=list_2,
    Tool=create_tool_2.Tool,
    Speed=Slider(10, range=0..1000),
    Command=merge,
    IsCartesian=True)
create_target_5 = CreateTarget(
    Plane=flip_plane_6,
    Motion=list_4,
    Tool=create_tool.Tool,
    Speed=Slider(10, range=0..1000),
    Command=merge_2,
    IsCartesian=True)
create_target_6 = CreateTarget(Plane=flip_plane_7, Motion=list_3, Tool=create_tool_2.Tool, Speed=Slider(200, range=0..1000), IsCartesian=True)
create_target_7 = CreateTarget(Plane=flip_plane_8, Motion=list_5, Tool=create_tool.Tool, Speed=Slider(200, range=0..1000), IsCartesian=True)

# ----
point_3 = Point(<point referenced from the Rhino model>)
xy_plane_6 = XYPlane(Origin=point_3)
flip_plane_9 = FlipPlane(Plane=xy_plane_6, ReverseX=False, ReverseY=True, SwapAxes=False)
list_6 = ValueList({"Joint", "Linear"}, selected="Joint")
series_2 = Series(Start=0, Step=1, Count=8)
create_target_8 = CreateTarget(Plane=flip_plane_9, Motion=list_6, Tool=create_tool_2.Tool, Speed="100", IsCartesian=True)
deconstruct_plane_9 = DeconstructPlane(Plane=flip_plane_9)  # -> Origin, XAxis, YAxis, ZAxis
multiplication_2 = Multiplication(A=deconstruct_plane_9.ZAxis, B=Slider(200, range=0..1000))
vector_display_2 = VectorDisplay(Anchor=deconstruct_plane_9.Origin, Vector=multiplication_2)
xy_plane_7 = XYPlane(Origin=Point(0, 0, 0))
flip_plane_10 = FlipPlane(Plane=xy_plane_7, ReverseX=False, ReverseY=False, SwapAxes=False)

# ---- group: Bricks Transport Visualisation / One brick
brep_3 = Brep(<brep referenced from the Rhino model>)

# ---- group: Target Creation -B
panel_2 = Panel("""SetDO out1, 1;
WaitTime 1;
SetDO out1, 0;""")
custom_command_2 = CustomCommand(Name="CloseTheGripper", Manufacturer="All", Code=panel_2)
unclose_gripper = ToolParameter(create_tool_2.Tool)
close_gripper = ToolParameter(create_tool.Tool)
list_7 = ValueList({"Joint", "Linear"}, selected="Linear")
list_8 = ValueList({"Joint", "Linear"}, selected="Joint")
create_target_9 = CreateTarget(Plane=rotate_3d_7.Geometry, Motion=list_7, Tool=unclose_gripper, Speed="10", Command=custom_command_2, IsCartesian=True)
list_length_2 = ListLength(List=create_target_9)
create_target_10 = CreateTarget(Plane=rotate_3d_8.Geometry, Motion=list_8, Tool=unclose_gripper, Speed=Slider(200, range=0..1000), IsCartesian=True)
series_3 = Series(Start=2, Step=2, Count=list_length_2)
list_9 = ValueList({"Joint", "Linear"}, selected="Linear")
panel_3 = Panel("""SetDO out2, 1;
WaitTime 1;
SetDO out2, 0;""")
home_target = TargetParameter(create_target_2)
series_4 = Series(Start=0, Step=3, Count=list_length_2)
create_target_11 = CreateTarget(Plane=rotate_3d_8.Geometry, Motion=list_9, Tool=close_gripper, Speed=Slider(10, range=0..1000), IsCartesian=True)
custom_command_3 = CustomCommand(Name="OpenTheGripper", Manufacturer="All", Code=panel_3)
series_5 = Series(Start=4, Step=4, Count=list_length_2)
list_10 = ValueList({"Joint", "Linear"}, selected="Joint")
home_target_2 = TargetParameter(create_target)
list_11 = ValueList({"Joint", "Linear"}, selected="Linear")
series_6 = Series(Start=5, Step=5, Count=list_length_2)
create_target_12 = CreateTarget(Plane=flip_plane_4, Motion=list_10, Tool=close_gripper, Speed="100", IsCartesian=True)
joint_configuration_3 = Panel("0,pi/2,0,0,0,0")
speed_mm_s_3 = Panel("100")
zone_mm_3 = Panel("0")
create_target_13 = CreateTarget(Plane=flip_plane_3, Motion=list_11, Tool=close_gripper, Speed="10", Command=custom_command_3, IsCartesian=True)
series_7 = Series(Start=6, Step=6, Count=list_length_2)
series_8 = Series(Start=7, Step=7, Count=list_length_2)
joints_parameter_3 = JointsParameter(joint_configuration_3)
speed_parameter_3 = SpeedParameter(speed_mm_s_3)
series_9 = Series(Start=8, Step=8, Count=list_length_2)
create_target_14 = CreateTarget(Joints=joints_parameter_3, Tool=create_tool_2.Tool, Speed=speed_parameter_3, Zone=zone_mm_3, IsCartesian=False)

# ----
insert_items = InsertItems(List=create_target_10, Item=create_target_8, Indices=series_2, Wrap=True)

# ---- group: Target Creation -B (continued)
insert_items_2 = InsertItems(List=insert_items, Item=create_target_9, Indices=series_3, Wrap=True)
insert_items_3 = InsertItems(List=insert_items_2, Item=home_target, Indices=series_4, Wrap=True)
insert_items_4 = InsertItems(List=insert_items_3, Item=create_target_11, Indices=series_5, Wrap=True)
insert_items_5 = InsertItems(List=insert_items_4, Item=home_target_2, Indices=series_6, Wrap=True)
insert_items_6 = InsertItems(List=insert_items_5, Item=create_target_12, Indices=series_7, Wrap=True)
insert_items_7 = InsertItems(List=insert_items_6, Item=create_target_13, Indices=series_8, Wrap=True)
insert_items_8 = InsertItems(List=insert_items_7, Item=create_target_14, Indices=series_9, Wrap=True)

# ----
panel_4 = Panel(insert_items_2)
panel_5 = Panel(insert_items_3)
panel_6 = Panel(insert_items_8)

# ---- group: Programm Generation
list_12 = RobotsLibrary(
    {"Indexlab-IRB6700-175", "Indexlab-IRB6700-175 + Positioner", "Indexlab", "Indexlab_ABB_IRB4600_205", "FanucM710iC", "FanucM710iC+GudelFanuc", "Fanuc R 2000 iC", "Fanuc R 2000 iC+GudelFanuc", "Fanuc Cell Indexlab", "Indexlab_Fanuc_LRMate200iD7L"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}, selected="Indexlab_ABB_IRB4600_205",
    Type=0)
merge_3 = Merge(
    Data1=create_target_2,
    Data2=create_target_6,
    Data3=create_target_4,
    Data4=create_target_3,
    Data5=create_target,
    Data6=create_target_7,
    Data7=create_target_5,
    Data8=create_target_2)
load_robot_system = LoadRobotSystem(Name=list_12, Base=flip_plane_10)

# ---- group: Programm Selection
value_list = ValueList({"A": 0, "B": 1}, selected="B")
stream_filter = StreamFilter(Gate=value_list, Stream0=merge_3, Stream1=insert_items_8)

# ---- group: Programm Generation (continued)
create_program = CreateProgram(Name="Home", RobotSystem=load_robot_system, Targets=stream_filter, StepSize=1)  # -> Program, Code, Duration, Warnings, Errors
panel_7 = Panel(create_program.Warnings)

# ----
code = Panel(create_program.Code)
panel_8 = Panel(create_program.Duration)
panel_9 = Panel(create_program.Errors)

# ---- group: Simulation
number_slider = Slider(0, range=0..1)

program_simulation = ProgramSimulation(Program=create_program.Program, Time=number_slider, Normalized=True)  # -> SystemMeshes, JointRotations, Plane, Index, Time, Program, Errors

# ----
degrees = Degrees(Radians=program_simulation.JointRotations)

# ---- group: Simulation (continued)
target_index = Panel(program_simulation.Index)
time = Panel(program_simulation.Time)
errors = Panel(degrees)

# ---- group: Table collision check
brep_4 = Brep(<brep referenced from the Rhino model>)
mesh_brep_3 = MeshBrep(
    Brep=brep_4,
    Settings={GridMaxCount=0, GridMinCount=16, JaggedSeams=False, MaxEdgeLength=0, MinEdgeLength=0.0001, MinTolerance=0, Refine=True, RefineAngle=0, RelativeTolerance=0.65, SimplePlanes=True, Tolerance=0})
collision_one_many = CollisionOneMany(Collider=program_simulation.SystemMeshes, Obstacles=mesh_brep_3)  # -> Collision, Index
panel_10 = Panel(collision_one_many.Collision)

# ---- group: Bricks Transport Visualisation / TCP Plane
list_item_2 = ListItem(List=program_simulation.Plane, Index=-1, Wrap=True)

# ---- group: Collision checked on brick / Gripper
list_item_3 = ListItem(List=program_simulation.SystemMeshes, Index=7, Wrap=True)

# ---- group: Bricks Transport Visualisation
deconstruct_brep_2 = DeconstructBrep(Brep=brep_3)  # -> Faces, Edges, Vertices
rotate_plane = RotatePlane(Plane=deconstruct_brep_2.Faces, Angle=degrees("90"))
plane_offset_5 = PlaneOffset(BasePlane=rotate_plane, Offset="-80")
list_item_4 = ListItem(List=plane_offset_5, Index=0, Wrap=True)
orient = Orient(Geometry=brep_3, Source=list_item_4, Target=list_item_2)  # -> Geometry, Transform
create_material = CreateMaterial(
    Diffuse=ColourSwatch(SwatchColor=RGB(23, 172, 255)),
    Specular=RGB(255, 255, 255),
    Emission=RGB(0, 0, 0),
    Transparency=0,
    Shine=0)

# ---- group: Collision checked on brick
collision_one_many_2 = CollisionOneMany(Collider=list_item_3, Obstacles=orient.Geometry)  # -> Collision, Index
python_3_script = Python3Script(x=collision_one_many_2.Collision, y=orient.Geometry)  # -> out, a
# ---------- python_3_script: Python ----------
if x==True:
    a = y
else:
    a = None
# ---------- end python_3_script ----------

# ----
panel_11 = Panel(collision_one_many_2.Collision)

# ---- group: Bricks Transport Visualisation (continued)
custom_preview = CustomPreview(Geometry=python_3_script.a, Material=create_material)
