# Grasshopper definition PickPlace_RobotComponent.gh (Grasshopper 1.0.8)
# plug-ins: Robots, Robot Components

# ---- group: Gripper Close / TCP orientation setup
tcp_close = Point(<point referenced from the Rhino model>)
xy_plane = XYPlane(Origin=tcp_close)
deconstruct_plane = DeconstructPlane(Plane=xy_plane)  # -> Origin, XAxis, YAxis, ZAxis
deconstruct_plane_2 = DeconstructPlane(Plane=xy_plane)  # -> Origin, XAxis, YAxis, ZAxis
deconstruct_plane_3 = DeconstructPlane(Plane=xy_plane)  # -> Origin, XAxis, YAxis, ZAxis
rotate_3d = Rotate3D(Geometry=xy_plane, Angle=degrees(Slider(0, range=0..100)), Center=deconstruct_plane.Origin, Axis=deconstruct_plane.XAxis)  # -> Geometry, Transform
rotate_3d_2 = Rotate3D(
    Geometry=rotate_3d.Geometry,
    Angle=degrees(Slider(0, range=0..100)),
    Center=deconstruct_plane_2.Origin,
    Axis=deconstruct_plane_2.YAxis)  # -> Geometry, Transform
rotate_3d_3 = Rotate3D(
    Geometry=rotate_3d_2.Geometry,
    Angle=degrees(Slider(0, range=0..100)),
    Center=deconstruct_plane_3.Origin,
    Axis=deconstruct_plane_3.ZAxis)  # -> Geometry, Transform

# ---- group: Bricks plane creation
brep = Brep([<brep referenced from the Rhino model> x8])
list_length = ListLength(List=brep)
deconstruct_brep = DeconstructBrep(Brep=brep)  # -> flatten(Faces), Edges, Vertices
series = Series(Start=2, Step=6, Count=list_length)
list_item = ListItem(List=deconstruct_brep.Faces, Index=series, Wrap=True)
polygon_center = PolygonCenter(Polyline=list_item)  # -> CenterV, CenterE, CenterA
construct_plane = ConstructPlane(Origin=polygon_center.CenterV, XAxis=Vector(1, 0, 0), YAxis=Vector(0, 1, 0))
unit_z = UnitZ(Factor="200")
flip_plane = FlipPlane(Plane=construct_plane, ReverseX=False, ReverseY=False, SwapAxes=True)
plane_offset = PlaneOffset(BasePlane=construct_plane, Offset=unit_z)
flip_plane_2 = FlipPlane(Plane=plane_offset, ReverseX=False, ReverseY=False, SwapAxes=True)

# ---- group: Torch Definition / TCP orientation setup
tcp_torch = Point(<point referenced from the Rhino model>)
xy_plane_2 = XYPlane(Origin=tcp_torch)
deconstruct_plane_4 = DeconstructPlane(Plane=xy_plane_2)  # -> Origin, XAxis, YAxis, ZAxis
deconstruct_plane_5 = DeconstructPlane(Plane=xy_plane_2)  # -> Origin, XAxis, YAxis, ZAxis
deconstruct_plane_6 = DeconstructPlane(Plane=xy_plane_2)  # -> Origin, XAxis, YAxis, ZAxis
rotate_3d_4 = Rotate3D(
    Geometry=xy_plane_2,
    Angle=degrees(Slider(0, range=0..100)),
    Center=deconstruct_plane_4.Origin,
    Axis=deconstruct_plane_4.XAxis)  # -> Geometry, Transform
rotate_3d_5 = Rotate3D(
    Geometry=rotate_3d_4.Geometry,
    Angle=degrees(Slider(135, range=0..150)),
    Center=deconstruct_plane_5.Origin,
    Axis=deconstruct_plane_5.YAxis)  # -> Geometry, Transform
rotate_3d_6 = Rotate3D(
    Geometry=rotate_3d_5.Geometry,
    Angle=degrees(Slider(0, range=0..100)),
    Center=deconstruct_plane_6.Origin,
    Axis=deconstruct_plane_6.ZAxis)  # -> Geometry, Transform

# ----
brep_2 = Brep([<brep referenced from the Rhino model> x8])

# ---- group: Gripper Close / Close Gripper
mesh_brep = MeshBrep(
    Brep=brep_2,
    Settings={GridMaxCount=0, GridMinCount=16, JaggedSeams=False, MaxEdgeLength=0, MinEdgeLength=0.0001, MinTolerance=0, Refine=True, RefineAngle=0, RelativeTolerance=0.65, SimplePlanes=True, Tolerance=0})
mesh = Mesh(mesh_brep)
mesh_join = MeshJoin(Meshes=mesh)

# ---- group: Table Plane Creation
subtraction = Subtraction(A=list_length, B=1)
curve = Curve(<curve referenced from the Rhino model>)
divide_curve = DivideCurve(Curve=curve, Count=subtraction, Kinks=False)  # -> Points, Tangents, Parameters
xy_plane_3 = XYPlane(Origin=divide_curve.Points)
unit_z_2 = UnitZ(Factor="200")
flip_plane_3 = FlipPlane(Plane=xy_plane_3, ReverseX=False, ReverseY=False, SwapAxes=True)
plane_offset_2 = PlaneOffset(BasePlane=xy_plane_3, Offset=unit_z_2)
flip_plane_4 = FlipPlane(Plane=plane_offset_2, ReverseX=False, ReverseY=False, SwapAxes=True)

# ---- group: Gripper Close
load_data = LoadData(Mass="5.6")
robot_tool = RobotTool(
    Name="GripperClose",
    Mesh=mesh_join,
    AttachmentPlane=PlaneXY(0, 0, 0),
    ToolPlane=rotate_3d_3.Geometry,
    LoadData=load_data)

# ----
deconstruct_plane_7 = DeconstructPlane(Plane=flip_plane)  # -> Origin, XAxis, YAxis, ZAxis
multiplication = Multiplication(A=deconstruct_plane_7.ZAxis, B=Slider(200, range=0..1000))
deconstruct_plane_8 = DeconstructPlane(Plane=flip_plane_2)  # -> Origin, XAxis, YAxis, ZAxis
vector_display = VectorDisplay(Anchor=deconstruct_plane_7.Origin, Vector=multiplication)
rotate_3d_7 = Rotate3D(
    Geometry=flip_plane,
    Angle=degrees(Slider(90, range=-180..180)),
    Center=deconstruct_plane_7.Origin,
    Axis=deconstruct_plane_7.ZAxis)  # -> Geometry, Transform
rotate_3d_8 = Rotate3D(
    Geometry=flip_plane_2,
    Angle=degrees(Slider(90, range=-180..180)),
    Center=deconstruct_plane_8.Origin,
    Axis=deconstruct_plane_8.ZAxis)  # -> Geometry, Transform

point = Point(<point referenced from the Rhino model>)
point_2 = Point(<point referenced from the Rhino model>)
xy_plane_4 = XYPlane(Origin=point_2)
xy_plane_5 = XYPlane(Origin=point)
work_object = WorkObject(Name="TableFrame", Plane=xy_plane_4)
work_object_2 = WorkObject(Name="BrickFrame", Plane=xy_plane_5)

robot_joint_position = RobotJointPosition(
    RobotJointPosition1=0,
    RobotJointPosition2=1.570796327,
    RobotJointPosition3=0,
    RobotJointPosition4=0,
    RobotJointPosition5=0,
    RobotJointPosition6=0)
joint_target = JointTarget(RobotJointPosition=robot_joint_position)
robot_target = RobotTarget(Plane=rotate_3d_7.Geometry, ReferencePlane=work_object_2, Set_External_Joint_Position=False, Set_Reference_Plane=True)
robot_target_2 = RobotTarget(Plane=flip_plane_4, ReferencePlane=work_object, Set_External_Joint_Position=False, Set_Reference_Plane=True)
robot_target_3 = RobotTarget(Plane=flip_plane_3, ReferencePlane=work_object, Set_External_Joint_Position=False, Set_Reference_Plane=True)
robot_target_4 = RobotTarget(Plane=rotate_3d_8.Geometry, ReferencePlane=work_object_2, Set_External_Joint_Position=False, Set_Reference_Plane=True)
robot_target_5 = RobotTarget(Plane=rotate_3d_8.Geometry, ReferencePlane=work_object_2, Set_External_Joint_Position=False, Set_Reference_Plane=True)
robot_target_6 = RobotTarget(Plane=flip_plane_4, ReferencePlane=work_object, Set_External_Joint_Position=False, Set_Reference_Plane=True)
list_length_2 = ListLength(List=rotate_3d_8.Geometry)
list = ValueList({"v5": 5, "v10": 10, "v20": 20, "v30": 30, "v40": 40, "v50": 50, "v60": 60, "v80": 80, "v100": 100, "v150": 150, "v200": 200, "v300": 300, "v400": 400, "v500": 500, "v600": 600, "v800": 800, "v1000": 1000, "v1500": 1500, "v2000": 2000, "v2500": 2500, "v3000": 3000, "v4000": 4000, "v5000": 5000, "v6000": 6000, "v7000": 7000}, selected="v200")
list_2 = ValueList({"z0": 0, "z1": 1, "z5": 5, "z10": 10, "z15": 15, "z20": 20, "z30": 30, "z40": 40, "z50": 50, "z60": 60, "z80": 80, "z100": 100, "z150": 150, "z200": 200, "fine": -1}, selected="fine")
list_3 = ValueList({"MoveAbsJ": 0, "MoveL": 1, "MoveJ": 2, "MoveC": 3}, selected="MoveAbsJ")
list_4 = ValueList({"MoveAbsJ": 0, "MoveL": 1, "MoveJ": 2, "MoveC": 3}, selected="MoveJ")
list_5 = ValueList({"MoveAbsJ": 0, "MoveL": 1, "MoveJ": 2, "MoveC": 3}, selected="MoveL")
list_6 = ValueList({"MoveAbsJ": 0, "MoveL": 1, "MoveJ": 2, "MoveC": 3}, selected="MoveJ")
list_7 = ValueList({"MoveAbsJ": 0, "MoveL": 1, "MoveJ": 2, "MoveC": 3}, selected="MoveL")
list_8 = ValueList({"v5": 5, "v10": 10, "v20": 20, "v30": 30, "v40": 40, "v50": 50, "v60": 60, "v80": 80, "v100": 100, "v150": 150, "v200": 200, "v300": 300, "v400": 400, "v500": 500, "v600": 600, "v800": 800, "v1000": 1000, "v1500": 1500, "v2000": 2000, "v2500": 2500, "v3000": 3000, "v4000": 4000, "v5000": 5000, "v6000": 6000, "v7000": 7000}, selected="v200")
list_9 = ValueList({"v5": 5, "v10": 10, "v20": 20, "v30": 30, "v40": 40, "v50": 50, "v60": 60, "v80": 80, "v100": 100, "v150": 150, "v200": 200, "v300": 300, "v400": 400, "v500": 500, "v600": 600, "v800": 800, "v1000": 1000, "v1500": 1500, "v2000": 2000, "v2500": 2500, "v3000": 3000, "v4000": 4000, "v5000": 5000, "v6000": 6000, "v7000": 7000}, selected="v50")
list_10 = ValueList({"v5": 5, "v10": 10, "v20": 20, "v30": 30, "v40": 40, "v50": 50, "v60": 60, "v80": 80, "v100": 100, "v150": 150, "v200": 200, "v300": 300, "v400": 400, "v500": 500, "v600": 600, "v800": 800, "v1000": 1000, "v1500": 1500, "v2000": 2000, "v2500": 2500, "v3000": 3000, "v4000": 4000, "v5000": 5000, "v6000": 6000, "v7000": 7000}, selected="v200")
list_11 = ValueList({"v5": 5, "v10": 10, "v20": 20, "v30": 30, "v40": 40, "v50": 50, "v60": 60, "v80": 80, "v100": 100, "v150": 150, "v200": 200, "v300": 300, "v400": 400, "v500": 500, "v600": 600, "v800": 800, "v1000": 1000, "v1500": 1500, "v2000": 2000, "v2500": 2500, "v3000": 3000, "v4000": 4000, "v5000": 5000, "v6000": 6000, "v7000": 7000}, selected="v50")
list_12 = ValueList({"MoveAbsJ": 0, "MoveL": 1, "MoveJ": 2, "MoveC": 3}, selected="MoveL")
list_13 = ValueList({"MoveAbsJ": 0, "MoveL": 1, "MoveJ": 2, "MoveC": 3}, selected="MoveL")
list_14 = ValueList({"v5": 5, "v10": 10, "v20": 20, "v30": 30, "v40": 40, "v50": 50, "v60": 60, "v80": 80, "v100": 100, "v150": 150, "v200": 200, "v300": 300, "v400": 400, "v500": 500, "v600": 600, "v800": 800, "v1000": 1000, "v1500": 1500, "v2000": 2000, "v2500": 2500, "v3000": 3000, "v4000": 4000, "v5000": 5000, "v6000": 6000, "v7000": 7000}, selected="v50")
list_15 = ValueList({"v5": 5, "v10": 10, "v20": 20, "v30": 30, "v40": 40, "v50": 50, "v60": 60, "v80": 80, "v100": 100, "v150": 150, "v200": 200, "v300": 300, "v400": 400, "v500": 500, "v600": 600, "v800": 800, "v1000": 1000, "v1500": 1500, "v2000": 2000, "v2500": 2500, "v3000": 3000, "v4000": 4000, "v5000": 5000, "v6000": 6000, "v7000": 7000}, selected="v50")
list_16 = ValueList({"z0": 0, "z1": 1, "z5": 5, "z10": 10, "z15": 15, "z20": 20, "z30": 30, "z40": 40, "z50": 50, "z60": 60, "z80": 80, "z100": 100, "z150": 150, "z200": 200, "fine": -1}, selected="fine")
list_17 = ValueList({"z0": 0, "z1": 1, "z5": 5, "z10": 10, "z15": 15, "z20": 20, "z30": 30, "z40": 40, "z50": 50, "z60": 60, "z80": 80, "z100": 100, "z150": 150, "z200": 200, "fine": -1}, selected="fine")
list_18 = ValueList({"z0": 0, "z1": 1, "z5": 5, "z10": 10, "z15": 15, "z20": 20, "z30": 30, "z40": 40, "z50": 50, "z60": 60, "z80": 80, "z100": 100, "z150": 150, "z200": 200, "fine": -1}, selected="fine")
list_19 = ValueList({"z0": 0, "z1": 1, "z5": 5, "z10": 10, "z15": 15, "z20": 20, "z30": 30, "z40": 40, "z50": 50, "z60": 60, "z80": 80, "z100": 100, "z150": 150, "z200": 200, "fine": -1}, selected="fine")
list_20 = ValueList({"z0": 0, "z1": 1, "z5": 5, "z10": 10, "z15": 15, "z20": 20, "z30": 30, "z40": 40, "z50": 50, "z60": 60, "z80": 80, "z100": 100, "z150": 150, "z200": 200, "fine": -1}, selected="fine")
list_21 = ValueList({"z0": 0, "z1": 1, "z5": 5, "z10": 10, "z15": 15, "z20": 20, "z30": 30, "z40": 40, "z50": 50, "z60": 60, "z80": 80, "z100": 100, "z150": 150, "z200": 200, "fine": -1}, selected="fine")
move = Move(
    Type=list_3,
    Target=joint_target,
    SpeedData=list,
    ZoneData=list_2,
    Override_Robot_Tool=False,
    Override_Work_Object=True,
    Set_Circular_Point=False,
    Set_Digital_Output=False,
    Set_Movement_Time=False)
move_2 = Move(
    Type=list_4,
    Target=robot_target_2,
    SpeedData=list_8,
    ZoneData=list_16,
    WorkObject=work_object,
    Override_Robot_Tool=False,
    Override_Work_Object=True,
    Set_Circular_Point=False,
    Set_Digital_Output=False,
    Set_Movement_Time=False)
move_3 = Move(
    Type=list_5,
    Target=robot_target_3,
    SpeedData=list_9,
    ZoneData=list_17,
    WorkObject=work_object,
    Override_Robot_Tool=False,
    Override_Work_Object=True,
    Set_Circular_Point=False,
    Set_Digital_Output=False,
    Set_Movement_Time=False)
move_4 = Move(
    Type=list_6,
    Target=robot_target_4,
    SpeedData=list_10,
    ZoneData=list_18,
    WorkObject=work_object_2,
    Override_Robot_Tool=False,
    Override_Work_Object=True,
    Set_Circular_Point=False,
    Set_Digital_Output=False,
    Set_Movement_Time=False)
move_5 = Move(
    Type=list_7,
    Target=robot_target_5,
    SpeedData=list_11,
    ZoneData=list_19,
    WorkObject=work_object_2,
    Override_Robot_Tool=False,
    Override_Work_Object=True,
    Set_Circular_Point=False,
    Set_Digital_Output=False,
    Set_Movement_Time=False)
move_6 = Move(
    Type=list_12,
    Target=robot_target_6,
    SpeedData=list_15,
    ZoneData=list_20,
    WorkObject=work_object,
    Override_Robot_Tool=False,
    Override_Work_Object=True,
    Set_Circular_Point=False,
    Set_Digital_Output=False,
    Set_Movement_Time=False)
move_7 = Move(
    Type=list_13,
    Target=robot_target,
    SpeedData=list_14,
    ZoneData=list_21,
    WorkObject=work_object_2,
    Override_Robot_Tool=False,
    Override_Work_Object=True,
    Set_Circular_Point=False,
    Set_Digital_Output=False,
    Set_Movement_Time=False)
series_2 = Series(Start=0, Step=1, Count=8)
insert_items = InsertItems(List=move_4, Item=move, Indices=series_2, Wrap=True)
series_3 = Series(Start=2, Step=2, Count=list_length_2)
series_4 = Series(Start=3, Step=3, Count=list_length_2)
insert_items_2 = InsertItems(List=insert_items, Item=move_7, Indices=series_3, Wrap=True)
series_5 = Series(Start=4, Step=4, Count=list_length_2)
insert_items_3 = InsertItems(List=insert_items_2, Item=move_5, Indices=series_4, Wrap=True)
series_6 = Series(Start=5, Step=5, Count=list_length_2)
insert_items_4 = InsertItems(List=insert_items_3, Item=move, Indices=series_5, Wrap=True)
series_7 = Series(Start=6, Step=6, Count=list_length_2)
insert_items_5 = InsertItems(List=insert_items_4, Item=move_2, Indices=series_6, Wrap=True)
series_8 = Series(Start=7, Step=7, Count=list_length_2)
insert_items_6 = InsertItems(List=insert_items_5, Item=move_3, Indices=series_7, Wrap=True)
series_9 = Series(Start=8, Step=8, Count=list_length_2)
insert_items_7 = InsertItems(List=insert_items_6, Item=move_6, Indices=series_8, Wrap=True)
insert_items_8 = InsertItems(List=insert_items_7, Item=move, Indices=series_9, Wrap=True)

value_list = ValueList({"A": 0, "B": 1}, selected="B")
panel = Panel(insert_items_8)

tcp_unclose = Point(<point referenced from the Rhino model>)
xy_plane_6 = XYPlane(Origin=tcp_unclose)
unclose_geometry = Brep([<brep referenced from the Rhino model> x8])
deconstruct_plane_9 = DeconstructPlane(Plane=xy_plane_6)  # -> Origin, XAxis, YAxis, ZAxis
deconstruct_plane_10 = DeconstructPlane(Plane=xy_plane_6)  # -> Origin, XAxis, YAxis, ZAxis
deconstruct_plane_11 = DeconstructPlane(Plane=xy_plane_6)  # -> Origin, XAxis, YAxis, ZAxis
rotate_3d_9 = Rotate3D(
    Geometry=xy_plane_6,
    Angle=degrees(Slider(0, range=0..100)),
    Center=deconstruct_plane_9.Origin,
    Axis=deconstruct_plane_9.XAxis)  # -> Geometry, Transform
rotate_3d_10 = Rotate3D(
    Geometry=rotate_3d_9.Geometry,
    Angle=degrees(Slider(0, range=0..100)),
    Center=deconstruct_plane_10.Origin,
    Axis=deconstruct_plane_10.YAxis)  # -> Geometry, Transform
rotate_3d_11 = Rotate3D(
    Geometry=rotate_3d_10.Geometry,
    Angle=degrees(Slider(0, range=0..100)),
    Center=deconstruct_plane_11.Origin,
    Axis=deconstruct_plane_11.ZAxis)  # -> Geometry, Transform
load_data_2 = LoadData(Mass="5.6")

# ---- group: Close Gripper
mesh_brep_2 = MeshBrep(
    Brep=unclose_geometry,
    Settings={GridMaxCount=0, GridMinCount=16, JaggedSeams=False, MaxEdgeLength=0, MinEdgeLength=0.0001, MinTolerance=0, Refine=True, RefineAngle=0, RelativeTolerance=0.65, SimplePlanes=True, Tolerance=0})
mesh_2 = Mesh(mesh_brep_2)
mesh_join_2 = MeshJoin(Meshes=mesh_2)

# ----
robot_tool_2 = RobotTool(
    Name="GripperUnclose",
    Mesh=mesh_join_2,
    AttachmentPlane=PlaneXY(0, 0, 0),
    ToolPlane=rotate_3d_11.Geometry,
    LoadData=load_data_2)

point_3 = Point(<point referenced from the Rhino model>)
point_4 = Point(<point referenced from the Rhino model>)
xy_plane_7 = XYPlane(Origin=point_3)
xy_plane_8 = XYPlane(Origin=point_4)
work_object_3 = WorkObject(Name="BrickFrame", Plane=xy_plane_7)
work_object_4 = WorkObject(Name="TableFrame", Plane=xy_plane_8)
configuration_data = ConfigurationData(CF1=0, CF4=0, CF6=0, CFX=0)
point_5 = Point(<point referenced from the Rhino model>)
unit_z_3 = UnitZ(Factor="200")
point_6 = Point(<point referenced from the Rhino model>)
xy_plane_9 = XYPlane(Origin=point_5)
xy_plane_10 = XYPlane(Origin=point_6)
plane_offset_3 = PlaneOffset(BasePlane=xy_plane_10, Offset=unit_z_3)
flip_plane_5 = FlipPlane(Plane=xy_plane_10, ReverseX=False, ReverseY=False, SwapAxes=True)
unit_z_4 = UnitZ(Factor="200")
flip_plane_6 = FlipPlane(Plane=plane_offset_3, ReverseX=False, ReverseY=False, SwapAxes=True)
robot_joint_position_2 = RobotJointPosition(
    RobotJointPosition1=0,
    RobotJointPosition2=1.570796327,
    RobotJointPosition3=0,
    RobotJointPosition4=0,
    RobotJointPosition5=0,
    RobotJointPosition6=0)
number_slider = Slider(90, range=-180..180)
deconstruct_plane_12 = DeconstructPlane(Plane=flip_plane_5)  # -> Origin, XAxis, YAxis, ZAxis
plane_offset_4 = PlaneOffset(BasePlane=xy_plane_9, Offset=unit_z_4)
deconstruct_plane_13 = DeconstructPlane(Plane=flip_plane_6)  # -> Origin, XAxis, YAxis, ZAxis
flip_plane_7 = FlipPlane(Plane=xy_plane_9, ReverseX=False, ReverseY=False, SwapAxes=True)
rotate_3d_12 = Rotate3D(Geometry=flip_plane_6, Angle=degrees(number_slider), Center=deconstruct_plane_13.Origin, Axis=deconstruct_plane_13.ZAxis)  # -> Geometry, Transform
flip_plane_8 = FlipPlane(Plane=plane_offset_4, ReverseX=False, ReverseY=False, SwapAxes=True)
rotate_3d_13 = Rotate3D(Geometry=flip_plane_5, Angle=degrees(number_slider), Center=deconstruct_plane_12.Origin, Axis=deconstruct_plane_12.ZAxis)  # -> Geometry, Transform
joint_target_2 = JointTarget(Name="Home", RobotJointPosition=robot_joint_position_2)
robot_target_7 = RobotTarget(
    Plane=flip_plane_8,
    ReferencePlane=work_object_4,
    ConfigurationData=configuration_data,
    Set_External_Joint_Position=False,
    Set_Reference_Plane=True)
robot_target_8 = RobotTarget(
    Plane=flip_plane_6,
    ReferencePlane=work_object_3,
    ConfigurationData=configuration_data,
    Set_External_Joint_Position=False,
    Set_Reference_Plane=True)
robot_target_9 = RobotTarget(
    Plane=rotate_3d_13.Geometry,
    ReferencePlane=work_object_3,
    ConfigurationData=configuration_data,
    Set_External_Joint_Position=False,
    Set_Reference_Plane=True)
robot_target_10 = RobotTarget(
    Plane=rotate_3d_12.Geometry,
    ReferencePlane=work_object_3,
    ConfigurationData=configuration_data,
    Set_External_Joint_Position=False,
    Set_Reference_Plane=True)
set_digital_output = SetDigitalOutput(Name="out1", State="1")
set_digital_output_2 = SetDigitalOutput(Name="out2", State="0")
robot_target_11 = RobotTarget(
    Plane=flip_plane_7,
    ReferencePlane=work_object_4,
    ConfigurationData=configuration_data,
    Set_External_Joint_Position=False,
    Set_Reference_Plane=True)
list_22 = ValueList({"v5": 5, "v10": 10, "v20": 20, "v30": 30, "v40": 40, "v50": 50, "v60": 60, "v80": 80, "v100": 100, "v150": 150, "v200": 200, "v300": 300, "v400": 400, "v500": 500, "v600": 600, "v800": 800, "v1000": 1000, "v1500": 1500, "v2000": 2000, "v2500": 2500, "v3000": 3000, "v4000": 4000, "v5000": 5000, "v6000": 6000, "v7000": 7000}, selected="v200")
list_23 = ValueList({"MoveAbsJ": 0, "MoveL": 1, "MoveJ": 2, "MoveC": 3}, selected="MoveAbsJ")
list_24 = ValueList({"z0": 0, "z1": 1, "z5": 5, "z10": 10, "z15": 15, "z20": 20, "z30": 30, "z40": 40, "z50": 50, "z60": 60, "z80": 80, "z100": 100, "z150": 150, "z200": 200, "fine": -1}, selected="fine")
list_25 = ValueList({"MoveAbsJ": 0, "MoveL": 1, "MoveJ": 2, "MoveC": 3}, selected="MoveJ")
wait_time = WaitTime(InPosition=False, Duration=".5")
set_digital_output_3 = SetDigitalOutput(Name="out1", State="0")
set_digital_output_4 = SetDigitalOutput(Name="out1", State="1")
list_26 = ValueList({"v5": 5, "v10": 10, "v20": 20, "v30": 30, "v40": 40, "v50": 50, "v60": 60, "v80": 80, "v100": 100, "v150": 150, "v200": 200, "v300": 300, "v400": 400, "v500": 500, "v600": 600, "v800": 800, "v1000": 1000, "v1500": 1500, "v2000": 2000, "v2500": 2500, "v3000": 3000, "v4000": 4000, "v5000": 5000, "v6000": 6000, "v7000": 7000}, selected="v200")
wait_time_2 = WaitTime(InPosition=False, Duration=".5")
set_digital_output_5 = SetDigitalOutput(Name="out2", State="0")
set_digital_output_6 = SetDigitalOutput(Name="out2", State="1")
list_27 = ValueList({"MoveAbsJ": 0, "MoveL": 1, "MoveJ": 2, "MoveC": 3}, selected="MoveL")
list_28 = ValueList({"MoveAbsJ": 0, "MoveL": 1, "MoveJ": 2, "MoveC": 3}, selected="MoveL")
list_29 = ValueList({"z0": 0, "z1": 1, "z5": 5, "z10": 10, "z15": 15, "z20": 20, "z30": 30, "z40": 40, "z50": 50, "z60": 60, "z80": 80, "z100": 100, "z150": 150, "z200": 200, "fine": -1}, selected="fine")
list_30 = ValueList({"MoveAbsJ": 0, "MoveL": 1, "MoveJ": 2, "MoveC": 3}, selected="MoveL")
move_8 = Move(
    Type=list_23,
    Target=joint_target_2,
    SpeedData=list_22,
    ZoneData=list_24,
    RobotTool=robot_tool_2,
    Override_Robot_Tool=True,
    Override_Work_Object=False,
    Set_Circular_Point=False,
    Set_Digital_Output=False,
    Set_Movement_Time=False)
list_31 = ValueList({"MoveAbsJ": 0, "MoveL": 1, "MoveJ": 2, "MoveC": 3}, selected="MoveJ")
list_32 = ValueList({"v5": 5, "v10": 10, "v20": 20, "v30": 30, "v40": 40, "v50": 50, "v60": 60, "v80": 80, "v100": 100, "v150": 150, "v200": 200, "v300": 300, "v400": 400, "v500": 500, "v600": 600, "v800": 800, "v1000": 1000, "v1500": 1500, "v2000": 2000, "v2500": 2500, "v3000": 3000, "v4000": 4000, "v5000": 5000, "v6000": 6000, "v7000": 7000}, selected="v50")
list_33 = ValueList({"v5": 5, "v10": 10, "v20": 20, "v30": 30, "v40": 40, "v50": 50, "v60": 60, "v80": 80, "v100": 100, "v150": 150, "v200": 200, "v300": 300, "v400": 400, "v500": 500, "v600": 600, "v800": 800, "v1000": 1000, "v1500": 1500, "v2000": 2000, "v2500": 2500, "v3000": 3000, "v4000": 4000, "v5000": 5000, "v6000": 6000, "v7000": 7000}, selected="v50")
list_34 = ValueList({"z0": 0, "z1": 1, "z5": 5, "z10": 10, "z15": 15, "z20": 20, "z30": 30, "z40": 40, "z50": 50, "z60": 60, "z80": 80, "z100": 100, "z150": 150, "z200": 200, "fine": -1}, selected="fine")
list_35 = ValueList({"v5": 5, "v10": 10, "v20": 20, "v30": 30, "v40": 40, "v50": 50, "v60": 60, "v80": 80, "v100": 100, "v150": 150, "v200": 200, "v300": 300, "v400": 400, "v500": 500, "v600": 600, "v800": 800, "v1000": 1000, "v1500": 1500, "v2000": 2000, "v2500": 2500, "v3000": 3000, "v4000": 4000, "v5000": 5000, "v6000": 6000, "v7000": 7000}, selected="v200")
list_36 = ValueList({"v5": 5, "v10": 10, "v20": 20, "v30": 30, "v40": 40, "v50": 50, "v60": 60, "v80": 80, "v100": 100, "v150": 150, "v200": 200, "v300": 300, "v400": 400, "v500": 500, "v600": 600, "v800": 800, "v1000": 1000, "v1500": 1500, "v2000": 2000, "v2500": 2500, "v3000": 3000, "v4000": 4000, "v5000": 5000, "v6000": 6000, "v7000": 7000}, selected="v50")
list_37 = ValueList({"z0": 0, "z1": 1, "z5": 5, "z10": 10, "z15": 15, "z20": 20, "z30": 30, "z40": 40, "z50": 50, "z60": 60, "z80": 80, "z100": 100, "z150": 150, "z200": 200, "fine": -1}, selected="fine")
list_38 = ValueList({"z0": 0, "z1": 1, "z5": 5, "z10": 10, "z15": 15, "z20": 20, "z30": 30, "z40": 40, "z50": 50, "z60": 60, "z80": 80, "z100": 100, "z150": 150, "z200": 200, "fine": -1}, selected="fine")
list_39 = ValueList({"z0": 0, "z1": 1, "z5": 5, "z10": 10, "z15": 15, "z20": 20, "z30": 30, "z40": 40, "z50": 50, "z60": 60, "z80": 80, "z100": 100, "z150": 150, "z200": 200, "fine": -1}, selected="fine")
merge = Merge(Data1=set_digital_output, Data2=set_digital_output_2)
move_9 = Move(
    Type=list_27,
    Target=robot_target_10,
    SpeedData=list_32,
    ZoneData=list_34,
    RobotTool=robot_tool_2,
    WorkObject=work_object_3,
    Override_Robot_Tool=True,
    Override_Work_Object=True,
    Set_Circular_Point=False,
    Set_Digital_Output=False,
    Set_Movement_Time=False)
move_10 = Move(
    Type=list_25,
    Target=robot_target_7,
    SpeedData=list_26,
    ZoneData=list_29,
    RobotTool=robot_tool_2,
    WorkObject=work_object_4,
    Override_Robot_Tool=True,
    Override_Work_Object=True,
    Set_Circular_Point=False,
    Set_Digital_Output=False,
    Set_Movement_Time=False)
move_11 = Move(
    Type=list_31,
    Target=robot_target_10,
    SpeedData=list_35,
    ZoneData=list_38,
    RobotTool=robot_tool_2,
    WorkObject=work_object_3,
    Override_Robot_Tool=True,
    Override_Work_Object=True,
    Set_Circular_Point=False,
    Set_Digital_Output=False,
    Set_Movement_Time=False)
move_12 = Move(
    Type=list_30,
    Target=robot_target_9,
    SpeedData=list_36,
    ZoneData=list_37,
    RobotTool=robot_tool_2,
    WorkObject=work_object_3,
    Override_Robot_Tool=True,
    Override_Work_Object=True,
    Set_Circular_Point=False,
    Set_Digital_Output=False,
    Set_Movement_Time=False)
move_13 = Move(
    Type=list_28,
    Target=robot_target_11,
    SpeedData=list_33,
    ZoneData=list_39,
    RobotTool=robot_tool_2,
    WorkObject=work_object_4,
    Override_Robot_Tool=True,
    Override_Work_Object=True,
    Set_Circular_Point=False,
    Set_Digital_Output=False,
    Set_Movement_Time=False)
merge_2 = Merge(Data1=set_digital_output_4, Data2=wait_time, Data3=set_digital_output_3)
merge_3 = Merge(Data1=set_digital_output_6, Data2=wait_time_2, Data3=set_digital_output_5)
merge_4 = Merge(
    Data1=move_8,
    Data2=merge,
    Data3=move_11,
    Data4=move_12,
    Data5=merge_2,
    Data6=move_9,
    Data7=move_10,
    Data8=merge_3,
    Data9=move_13)

xy_plane_11 = XYPlane(Origin=Point(0, 0, 0))
plane_offset_5 = PlaneOffset(BasePlane=xy_plane_11, Offset="500")
robot_preset = RobotPreset(PositionPlane=plane_offset_5, RobotTool=robot_tool_2, Robot_Preset_Number=19)

stream_filter = StreamFilter(Gate=value_list, Stream0=merge_4, Stream1=insert_items_8)

rapid_generator = RAPIDGenerator(
    Robot=robot_preset,
    Action=stream_filter,
    Add_loaddata=False,
    Add_tooldata=False,
    Add_wobjdata=False,
    Module_Name=False,
    Output_loaddata=False,
    Output_tooldata=False,
    Output_wobjdata=False,
    Routine_Name=False)
panel_2 = Panel(rapid_generator)

number_slider_2 = Slider(0, range=0..1)
path_generator = PathGenerator(
    Robot=robot_preset,
    Action=stream_filter,
    Interpolations=Slider(132, range=0..1000),
    AnimationSlider=Slider(0, range=0..1),
    Update=True,
    Output_Error_Messages=True,
    Output_External_Axis_Planes=False,
    Output_External_Joint_Position=False,
    Output_External_Joint_Positions=False,
    Output_Movement=False,
    Output_Movements=False,
    Output_Path=True,
    Output_Posed_Meshes=False,
    Output_Robot_End_Plane=False,
    Output_Robot_End_Planes=False,
    Output_Robot_Joint_Position=False,
    Output_Robot_Joint_Positions=False,
    Preview_Path=True,
    Preview_Posed_Meshes=True)  # -> Path, ErrorMessages
panel_3 = Panel(path_generator.ErrorMessages)

# ---- group: Torch Definition
unclose_geometry_2 = Brep([<brep referenced from the Rhino model> x11])

# ---- group: Torch Definition / Close Gripper
mesh_brep_3 = MeshBrep(
    Brep=unclose_geometry_2,
    Settings={GridMaxCount=0, GridMinCount=16, JaggedSeams=False, MaxEdgeLength=0, MinEdgeLength=0.0001, MinTolerance=0, Refine=True, RefineAngle=0, RelativeTolerance=0.65, SimplePlanes=True, Tolerance=0})
mesh_3 = Mesh(mesh_brep_3)
mesh_join_3 = MeshJoin(Meshes=mesh_3)

# ---- group: Torch Definition (continued)
create_tool = CreateTool(Name="Torch", TCP=rotate_3d_6.Geometry, Weight="5.6", Mesh=mesh_join_3)  # -> Tool, TCP
